# Grasshopper definition 200812_2D pcb.gh (Grasshopper 1.0.7)
# plug-ins: Heteroptera, Human UI

approx_pitch_dimension = Slider(4, range=1..5)
colour = ColourPicker(PickedColour=RGBA(240, 240, 240, 137))
pickbtn = CreateRhinoPickButton(ButtonName="  JST  ", Prompt="Please select geometry...", AllowMultiple=True, AllowNone=True, Type=0, ButtonStyle=0)
colour_2 = ColourPicker(PickedColour=RGB(88, 40, 222))
colour_3 = ColourPicker(PickedColour=RGB(79, 79, 79))

button = CreateButton(ButtonName="reset", ButtonStyle=0)
values = ValueListener(Elements=button, SomeProperty=True)  # -> Values, Indices
pickbtn_2 = CreateRhinoPickButton(ButtonName="8", Prompt="Please select geometry...", AllowMultiple=True, AllowNone=values.Values, Type=0, ButtonStyle=0)
values_2 = ValueListener(Elements=pickbtn_2, SomeProperty=True)  # -> Values, Indices
stack = CreateStack(UIElements=[pickbtn_2, button], Horizontal=True)

# ---- group: 2
button_2 = CreateButton(ButtonName="reset", ButtonStyle=0)
values_3 = ValueListener(Elements=button_2, SomeProperty=True)  # -> Values, Indices
pickbtn_3 = CreateRhinoPickButton(ButtonName="2", Prompt="Please select geometry...", AllowMultiple=True, AllowNone=values_3.Values, Type=0, ButtonStyle=0)
values_4 = ValueListener(Elements=pickbtn_3, SomeProperty=True)  # -> Values, Indices
stack_2 = CreateStack(UIElements=[pickbtn_3, button_2], Horizontal=True)

# ----
button_3 = CreateButton(ButtonName="reset", ButtonStyle=0)
values_5 = ValueListener(Elements=button_3, SomeProperty=True)  # -> Values, Indices
pickbtn_4 = CreateRhinoPickButton(ButtonName="9", Prompt="Please select geometry...", AllowMultiple=True, AllowNone=values_5.Values, Type=0, ButtonStyle=0)
values_6 = ValueListener(Elements=pickbtn_4, SomeProperty=True)  # -> Values, Indices
stack_3 = CreateStack(UIElements=[pickbtn_4, button_3], Horizontal=True)

button_4 = CreateButton(ButtonName="reset", ButtonStyle=0)
values_7 = ValueListener(Elements=button_4, SomeProperty=True)  # -> Values, Indices
pickbtn_5 = CreateRhinoPickButton(
    ButtonName="10",
    Prompt="Please select geometry...",
    AllowMultiple=True,
    AllowNone=values_7.Values,
    Type=0,
    ButtonStyle=0)
values_8 = ValueListener(Elements=pickbtn_5, SomeProperty=True)  # -> Values, Indices
stack_4 = CreateStack(UIElements=[pickbtn_5, button_4], Horizontal=True)

# ---- group: 3
button_5 = CreateButton(ButtonName="reset", ButtonStyle=0)
values_9 = ValueListener(Elements=button_5, SomeProperty=True)  # -> Values, Indices
pickbtn_6 = CreateRhinoPickButton(ButtonName="3", Prompt="Please select geometry...", AllowMultiple=True, AllowNone=values_9.Values, Type=0, ButtonStyle=0)
values_10 = ValueListener(Elements=pickbtn_6, SomeProperty=True)  # -> Values, Indices
stack_5 = CreateStack(UIElements=[pickbtn_6, button_5], Horizontal=True)

# ---- group: 1
button_6 = CreateButton(ButtonName="Reset", ButtonStyle=0)
values_11 = ValueListener(Elements=button_6, SomeProperty=True)  # -> Values, Indices
pickbtn_7 = CreateRhinoPickButton(
    ButtonName="1",
    Prompt="Please select geometry...",
    AllowMultiple=True,
    AllowNone=values_11.Values,
    Type=0,
    ButtonStyle=0)
values_12 = ValueListener(Elements=pickbtn_7, SomeProperty=True)  # -> Values, Indices
stack_6 = CreateStack(UIElements=[pickbtn_7, button_6], Horizontal=True)

# ---- group: 4
button_7 = CreateButton(ButtonName="reset", ButtonStyle=0)
values_13 = ValueListener(Elements=button_7, SomeProperty=True)  # -> Values, Indices
pickbtn_8 = CreateRhinoPickButton(
    ButtonName="4",
    Prompt="Please select geometry...",
    AllowMultiple=True,
    AllowNone=values_13.Values,
    Type=0,
    ButtonStyle=0)
values_14 = ValueListener(Elements=pickbtn_8, SomeProperty=True)  # -> Values, Indices
stack_7 = CreateStack(UIElements=[pickbtn_8, button_7], Horizontal=True)

# ----
button_8 = CreateButton(ButtonName="reset", ButtonStyle=0)
values_15 = ValueListener(Elements=button_8, SomeProperty=True)  # -> Values, Indices
pickbtn_9 = CreateRhinoPickButton(
    ButtonName="7",
    Prompt="Please select geometry...",
    AllowMultiple=True,
    AllowNone=values_15.Values,
    Type=0,
    ButtonStyle=0)
values_16 = ValueListener(Elements=pickbtn_9, SomeProperty=True)  # -> Values, Indices
stack_8 = CreateStack(UIElements=[pickbtn_9, button_8], Horizontal=True)

button_9 = CreateButton(ButtonName="reset", ButtonStyle=0)
values_17 = ValueListener(Elements=button_9, SomeProperty=True)  # -> Values, Indices
pickbtn_10 = CreateRhinoPickButton(
    ButtonName="6",
    Prompt="Please select geometry...",
    AllowMultiple=True,
    AllowNone=values_17.Values,
    Type=0,
    ButtonStyle=0)
values_18 = ValueListener(Elements=pickbtn_10, SomeProperty=True)  # -> Values, Indices
stack_9 = CreateStack(UIElements=[pickbtn_10, button_9], Horizontal=True)

# ---- group: 5
button_10 = CreateButton(ButtonName="reset", ButtonStyle=0)
values_19 = ValueListener(Elements=button_10, SomeProperty=True)  # -> Values, Indices
pickbtn_11 = CreateRhinoPickButton(
    ButtonName="5",
    Prompt="Please select geometry...",
    AllowMultiple=True,
    AllowNone=values_19.Values,
    Type=0,
    ButtonStyle=0)
values_20 = ValueListener(Elements=pickbtn_11, SomeProperty=True)  # -> Values, Indices
stack_10 = CreateStack(UIElements=[pickbtn_11, button_10], Horizontal=True)

# ----
button_11 = CreateButton(ButtonName="reset", ButtonStyle=0)
values_21 = ValueListener(Elements=button_11, SomeProperty=True)  # -> Values, Indices
pickbtn_12 = CreateRhinoPickButton(
    ButtonName="6",
    Prompt="Please select geometry...",
    AllowMultiple=True,
    AllowNone=values_21.Values,
    Type=0,
    ButtonStyle=0)
values_22 = ValueListener(Elements=pickbtn_12, SomeProperty=True)  # -> Values, Indices
stack_11 = CreateStack(UIElements=[pickbtn_12, button_11], Horizontal=True)

# ---- group: Create UV grid
slider = CreateSlider(Slider=approx_pitch_dimension, ShowBounds=False, ShowTicks=False, ShowTooltip=False, ShowValLabel=True, showLabel=True)
values_23 = ValueListener(Elements=slider, SomeProperty=True)  # -> PitchDimension, Indices

# ----
label = CreateLabel(LabelText=" ", LabelSize=12, Justification=0)
pickbtn_13 = CreateRhinoPickButton(ButtonName="ADD SURFACE", Prompt="Please select geometry...", AllowMultiple=True, AllowNone=True, Type=0, ButtonStyle=0)
values_24 = ValueListener(Elements=pickbtn_13, SomeProperty=True)  # -> Values, Indices
brep = Brep(values_24.Values)
srf = Surface(brep)
preview = CustomPreview(Geometry=brep, Material=colour)
series = Series(Start=0, Step=1, Count=10)

# ---- group: Place the components
series_2 = Series(Start=0, Step=1, Count=10)
pulldown = CreatePulldownMenu(Label="Add Component", ListItems=series_2, showLabel=True)

# ----
series_3 = Series(Start=0, Step=1, Count=Slider(11, range=0..100))
pulldown_2 = CreatePulldownMenu(Label="No. of Interconnect", ListItems=series_3, showLabel=True)
values_25 = ValueListener(Elements=pulldown_2, SomeProperty=True)  # -> Values, Indices
subtraction = Subtraction(A=values_25.Values, B="1")

pulldown_3 = CreatePulldownMenu(Label="Add Component", ListItems=series, showLabel=True)
pickbtn_14 = CreateRhinoPickButton(ButtonName="ADD GEOMETRY", Prompt="Please select geometry...", AllowMultiple=True, AllowNone=True, Type=0, ButtonStyle=0)
values_26 = ValueListener(Elements=pickbtn_14, SomeProperty=True)  # -> Values, Indices
brep_2 = Brep(values_26.Values)
toggle = CreateToggle(Default=Toggle(False), Label="Export the interconnect")

# ----
# 2nd Window
interconnect_width = Slider(1.5, range=0.2..1.5)
interconnect_height = Slider(0.5, range=0..1)
slider_2 = CreateSlider(Slider=interconnect_width, ShowBounds=False, ShowTicks=False, ShowTooltip=False, ShowValLabel=True, showLabel=True)
values_27 = ValueListener(Elements=slider_2, SomeProperty=True)  # -> Values, Indices
slider_3 = CreateSlider(Slider=interconnect_height, ShowBounds=False, ShowTicks=False, ShowTooltip=False, ShowValLabel=True, showLabel=True)
values_28 = ValueListener(Elements=slider_3, SomeProperty=True)  # -> Values, Indices
stack_12 = CreateStack(UIElements=[slider_2, slider_3, toggle], Horizontal=False)  # -> flatten(Stack)

values_29 = ValueListener(Elements=toggle, SomeProperty=True)  # -> Values, Indices

rotation = Slider(360, range=0..360)

# ---- group: 555 / 555 Rotation
slider_4 = CreateSlider(Slider=rotation, ShowBounds=False, ShowTicks=False, ShowTooltip=False, ShowValLabel=True, showLabel=True)
values_30 = ValueListener(Elements=slider_4, SomeProperty=True)  # -> Values, Indices

# ---- group: 555
pickbtn_15 = CreateRhinoPickButton(ButtonName="555 IC", Prompt="Please select geometry...", AllowMultiple=False, AllowNone=True, Type=0, ButtonStyle=0)
toggle_2 = CreateToggle(Default=Toggle(True))
values_31 = ValueListener(Elements=pickbtn_15, SomeProperty=True)  # -> Values, Indices
values_32 = ValueListener(Elements=toggle_2, SomeProperty=True)  # -> Values, Indices
stack_13 = CreateStack(UIElements=[pickbtn_15, slider_4, toggle_2], Horizontal=True)
gate = StreamGate(Stream=values_31.Values, Gate=values_32.Values)  # -> Target0, Target1

# ----
rotation_2 = Slider(360, range=0..360)

# ---- group: LED_1
toggle_3 = BooleanToggle(True)
pickbtn_16 = CreateRhinoPickButton(ButtonName="LED_1", Prompt="Please select geometry...", AllowMultiple=False, AllowNone=True, Type=0, ButtonStyle=0)
toggle_4 = CreateToggle(Default=toggle_3)
values_33 = ValueListener(Elements=pickbtn_16, SomeProperty=True)  # -> Values, Indices
slider_5 = CreateSlider(Slider=rotation_2, ShowBounds=False, ShowTicks=False, ShowTooltip=False, ShowValLabel=True, showLabel=True)
values_34 = ValueListener(Elements=slider_5, SomeProperty=True)  # -> Values, Indices
values_35 = ValueListener(Elements=toggle_4, SomeProperty=True)  # -> Values, Indices
stack_14 = CreateStack(UIElements=[pickbtn_16, slider_5, toggle_4], Horizontal=True)
gate_2 = StreamGate(Stream=values_33.Values, Gate=values_35.Values)  # -> Target0, Target1

# ----
rotation_3 = Slider(360, range=0..360)

# ---- group: JST
toggle_5 = CreateToggle(Default=Toggle(True))
slider_6 = CreateSlider(Slider=rotation_3, ShowBounds=False, ShowTicks=False, ShowTooltip=False, ShowValLabel=True, showLabel=True)
values_36 = ValueListener(Elements=slider_6, SomeProperty=True)  # -> Values, Indices
values_37 = ValueListener(Elements=pickbtn, SomeProperty=True)  # -> Values, Indices
values_38 = ValueListener(Elements=toggle_5, SomeProperty=True)  # -> Values, Indices
stack_15 = CreateStack(UIElements=[pickbtn, slider_6, toggle_5], Horizontal=True)
gate_3 = StreamGate(Stream=values_37.Values, Gate=values_38.Values)  # -> Target0, Target1

# ---- group: led_2
pickbtn_17 = CreateRhinoPickButton(ButtonName="LED_2", Prompt="Please select geometry...", AllowMultiple=False, AllowNone=True, Type=0, ButtonStyle=0)
toggle_6 = CreateToggle(Default=Toggle(True))
values_39 = ValueListener(Elements=pickbtn_17, SomeProperty=True)  # -> Values, Indices
slider_7 = CreateSlider(Slider=rotation_3, ShowBounds=False, ShowTicks=False, ShowTooltip=False, ShowValLabel=True, showLabel=True)
values_40 = ValueListener(Elements=slider_7, SomeProperty=True)  # -> Values, Indices
values_41 = ValueListener(Elements=toggle_6, SomeProperty=True)  # -> Values, Indices
stack_16 = CreateStack(UIElements=[pickbtn_17, slider_7, toggle_6], Horizontal=True)
gate_4 = StreamGate(Stream=values_39.Values, Gate=values_41.Values)  # -> Target0, Target1

# ----
merge = Merge(Data1=stack_13, Data2=stack_14, Data3=stack_16, Data4=stack_15)

# ---- group: Place the components
label_2 = CreateLabel(LabelText="Place the components", LabelSize=24, Justification=0)
merge_2 = Merge(Data1=label_2, Data3=merge)  # -> flatten(Result)

# ---- group: POWER
jst = JST(location=gate_3.Target1, guide_srf=srf, rotation=values_36.Values)  # -> geo, cloud, x, x_2
graft = GraftTree(Tree=jst.cloud, IncludeEmptyLists=True, IncludeNullItems=True)
qb = QuickBaker(Geometry=graft, Bake=values_38.Values, referenceAll=1)

# ----
gate_5 = StreamGate(Stream=jst.geo, Gate=0)  # -> Target0, Target1
colour_4 = ColourPicker(PickedColour=RGBA(204, 199, 169, 187))
preview_2 = CustomPreview(Geometry=gate_5.Target0, Material=colour_4)

led = LED(location=gate_2.Target1, guide_srf=srf, rotation=values_34.Values)  # -> geo, cloud, x, x_2, preview_2, preview_3
pt = Point(graft(led.cloud))
qb_2 = QuickBaker(Geometry=pt, Bake=[toggle_3, values_35.Values], referenceAll=1)

_555 = _555(location=gate.Target1, guide_srf=srf, rotation=values_30.Values)  # -> geo, cloud, _1, _2, _3, _4, _5, _6, _7, _8
pt_2 = Point(graft(_555.cloud))
qb_3 = QuickBaker(Geometry=pt_2, Bake=values_32.Values, referenceAll=1)

# ---- group: 555
gate_6 = StreamGate(Stream=_555.cloud, Gate=0)  # -> Target0, Target1
gate_7 = StreamGate(Stream=_555.geo, Gate=0)  # -> Target0, Target1
cluster = Cluster(P=gate_6.Target0, G=gate_7.Target0, M=colour_3)

# ----
# Construct Pitch Grid
_2d_surface_analysis = _2DSurfaceAnalysis(S=srf, pitch_dimension=values_23.PitchDimension)  # -> lines, flatten(nodes), no_of_nodes

cps = ClosestPoints(Point=led.cloud, Cloud=_2d_surface_analysis.nodes, Count=Slider(4, range=0..10))  # -> ClosestPoint, CPIndex, Distance
ln = Line(StartPoint=pt, EndPoint=cps.ClosestPoint)

# ---- group: POWER (continued)
cps_2 = ClosestPoints(Point=jst.cloud, Cloud=_2d_surface_analysis.nodes, Count=Slider(4, range=0..10))  # -> ClosestPoint, CPIndex, Distance
ln_2 = Line(StartPoint=graft, EndPoint=cps_2.ClosestPoint)

# ----
cps_3 = ClosestPoints(Point=_555.cloud, Cloud=_2d_surface_analysis.nodes, Count=Slider(4, range=0..10))  # -> ClosestPoint, CPIndex, Distance
ln_3 = Line(StartPoint=pt_2, EndPoint=cps_3.ClosestPoint)

led_2 = LED(location=gate_4.Target1, guide_srf=srf, rotation=values_40.Values)  # -> geo, cloud, x, x_2, preview_2, preview_3
cps_4 = ClosestPoints(Point=led_2.cloud, Cloud=_2d_surface_analysis.nodes, Count=Slider(4, range=0..10))  # -> ClosestPoint, CPIndex, Distance
pt_3 = Point(graft(led_2.cloud))
ln_4 = Line(StartPoint=pt_3, EndPoint=cps_4.ClosestPoint)
qb_4 = QuickBaker(Geometry=pt_3, Bake=values_41.Values, referenceAll=1)

crv = Curve(_2d_surface_analysis.lines)
preview_3 = CustomPreview(Geometry=crv, Material=colour_2)

relay = Relay([led.preview_3, led_2.preview_3, jst.x_2])
relay_2 = Relay([led.preview_2, led_2.preview_2, jst.x])
gate_8 = StreamGate(Stream=relay, Gate=0)  # -> Target0, Target1
gate_9 = StreamGate(Stream=relay_2, Gate=0)  # -> Target0, Target1
gate_10 = StreamGate(Stream=[led_2.geo, led.geo], Gate=0)  # -> Target0, Target1
c_script = CSharpScript(T="+", P=gate_9.Target0)  # -> out, A; inputs T: String, P: Point3d; same code as c_script
c_script_2 = CSharpScript(T="-", P=gate_8.Target0)  # -> out, A; inputs T: String, P: Point3d; same code as c_script
colour_5 = ColourPicker(PickedColour=RGBA(84, 217, 17, 146))
preview_4 = CustomPreview(Geometry=gate_10.Target0, Material=colour_5)

# ---- group: Display no.of points
label_3 = CreateLabel(LabelText="no.nodes", LabelSize=12, Justification=0)
label_4 = CreateLabel(LabelText="Number of Nodes :", LabelSize=12, Justification=0)
setlabel = SetLabelContents(LabelToModify=label_3, NewLabelContents=_2d_surface_analysis.no_of_nodes)
stack_17 = CreateStack(UIElements=[label_4, label_3], Horizontal=True)

# ---- group: Toggle poitns on and off
toggle_7 = CreateToggle(Default=Toggle(False), Label="Activate the nodes")
values_42 = ValueListener(Elements=toggle_7, NameFilterS=toggle_7, SomeProperty=True)  # -> Values, Indices

# ----
qb_5 = QuickBaker(Geometry=_2d_surface_analysis.nodes, Layer="nodes", Bake=values_42.Values, referenceAll=1)

# ---- group: Node Generation
merge_3 = Merge(Data1=pickbtn_14, Data2=pickbtn_13, Data3=label, Data4=slider, Data5=toggle_7, Data6=stack_17)
merge_4 = Merge(Data1=merge_3)

# ---- group: CONNECT
interconnect = INTERCONNECT(
    underlying_grid=flatten([_2d_surface_analysis.lines, ln_3, ln, ln_4, ln_2]),
    grid_pitch_prox=0,
    surface=srf,
    ap=values_12.Values,
    bp=values_4.Values,
    cp=values_10.Values,
    dp=values_14.Values,
    ep=values_20.Values,
    fp_7=values_18.Values,
    fp_3=values_16.Values,
    fp_5=values_2.Values,
    fp_2=values_6.Values,
    fp_4=values_8.Values,
    fp_6=values_22.Values)  # -> A, B, C, D_9, D_7, D_8, D_3, D_5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
merge_5 = Merge(
    Data1=stack_6,
    Data2=stack_2,
    Data3=stack_5,
    Data4=stack_7,
    Data5=stack_10,
    Data6=stack_9,
    Data7=stack_8,
    Data8=stack,
    Data9=stack_3,
    Data10=stack_4,
    Data11=stack_11)

# ---- group: Draw Interconnect
crv_2 = Curve(graft([interconnect.A, interconnect.B, interconnect.C, interconnect.D_9, interconnect.D_7, interconnect.D_8, interconnect.D_3, interconnect.D_5, interconnect.D_2, interconnect.D_4, interconnect.D_6, interconnect.D]))
division = Division(A=values_27.Values, B=Slider(2, range=0..10))
neg = Negative(Value=division)
dom = ConstructDomain(DomainStart=neg, DomainEnd=division)
pframe = PerpFrame(Curve=reparameterize(crv_2), Parameter=Slider(0, range=0..100))
rectangle = Rectangle(Plane=pframe, XSize=values_28.Values, YSize=dom, Radius=0)  # -> Rectangle, Length
swp1 = Sweep1(Rail=crv_2, Sections=rectangle.Rectangle, Miter=1)
cap = CapHoles(Brep=swp1)

# ----
qb_6 = QuickBaker(Geometry=cap, Bake=values_29.Values, referenceAll=1)

# ---- group: Draw Interconnect
colour_6 = ColourPicker(PickedColour=RGBA(242, 138, 68, 201))
preview_5 = CustomPreview(Geometry=cap, Material=colour_6)

# ----
# UI geneator
number_slider = Slider(500, range=0..1000)
launchwin = LaunchWindow(Show=Toggle(True), Name="Surface prepartion", Width=number_slider, Height=400, ChildStatus=1, EnableHorizScroll=False)
split = SplitList(List=merge_5, Index=subtraction)  # -> ListA, ListB
simplegrid = CreateSimpleGrid(UIElements=split.ListA, RowDefinitions="2*", ColumnDefinitions="2*")

# ---- group: Draw Interconnect
label_5 = CreateLabel(LabelText="Draw Interconnects", LabelSize=24, Justification=0)
label_6 = CreateLabel(LabelText="             ", LabelSize=12, Justification=0)
merge_6 = Merge(Data1=label_6, Data2=label_5, Data3=pulldown_2, Data4=simplegrid)

# ----
merge_7 = Merge(Data1=merge_4, Data2=merge_2, Data3=merge_6, Data4=stack_12)
addelems = AddElements(Window=launchwin, Elements=flatten(merge_7), DoVLChecking=True)  # -> AddedElements, ElementNames

# ==== cluster _2DSurfaceAnalysis
pitch_dimension = ClusterInput()
S = ClusterInput()
dim = Dimensions(Surface=S)  # -> UDimension, VDimension
division = Division(A=dim.UDimension, B=pitch_dimension)
division_2 = Division(A=dim.VDimension, B=pitch_dimension)
sdivide = DivideSurface(Surface=S, UCount=division, VCount=division_2)  # -> simplify(flatten(Points)), Normals, Parameters
clean = CleanTree(RemoveNulls=True, RemoveInvalid=True, RemoveEmpty=False, Tree=sdivide.Points)
pt = Point(simplify(flatten(clean)))
pt_2 = Point(simplify(graft(clean)))
cps = ClosestPoints(Point=pt_2, Cloud=pt, Count=Slider(9, range=0..10))  # -> ClosestPoint, CPIndex, Distance
lng = ListLength(List=pt)
ln = Line(StartPoint=pt_2, EndPoint=cps.ClosestPoint)
no_of_nodes = ClusterOutput(lng)
lines = ClusterOutput(ln)
nodes = ClusterOutput(pt)

# ==== cluster _555
guide_srf = ClusterInput()
rotation = ClusterInput()
location = ClusterInput()
brep = Brep([<brep referenced from the Rhino model> x9])
pt = Point([<point referenced from the Rhino model> x8])
pt_2 = Point(location)
srf = Surface(guide_srf)

# ---- group: Centre of Pins
shift = ShiftList(List=pt, Shift=1, Wrap=True)
ln = Line(StartPoint=pt, EndPoint=shift)
join = JoinCurves(Curves=ln, Preserve=False)
pcen = PolygonCenter(Polyline=join)  # -> CenterV, CenterE, CenterA

# ----
number_slider = Slider(90, range=0..1000)
brep_cp = BrepClosestPoint(Point=pt_2, Brep=srf)  # -> Point, Normal, Distance
rad = Radians(Degrees=rotation)
pl = PlaneNormal(Origin=brep_cp.Point, ZAxis=brep_cp.Normal)
number_slider_2 = Slider(0, range=0..100)
rotate = Rotate(Geometry=pl, Angle=rad, Plane=pl)  # -> Geometry, Transform
orient = Orient(Geometry=brep, Source=pcen.CenterV, Target=rotate.Geometry)  # -> Geometry, Transform
orient_2 = Orient(Geometry=pt, Source=pcen.CenterV, Target=rotate.Geometry)  # -> Geometry, Transform
colour = ColourPicker(PickedColour=RGBA(78, 92, 120, 120))
srf_cp = SurfaceClosestPoint(Point=orient_2.Geometry, Surface=srf)  # -> Point, UVPoint, Distance
ins = InsertItems(List=srf_cp.Point, Item=number_slider_2, Indices=number_slider_2, Wrap=True)
colour_2 = ColourPicker(PickedColour=RGBA(255, 66, 66, 213))
sph = Sphere(Base=srf_cp.Point, Radius=Slider(0.1, range=0..1))
points = PointList(Points=ins, Size=Slider(2, range=0..10))
preview = CustomPreview(Geometry=sph, Material=colour_2)
preview_2 = CustomPreview(Geometry=orient.Geometry, Material=colour)
item = ListItem(List=srf_cp.Point, Index="0", Wrap=True)
item_2 = ListItem(List=srf_cp.Point, Index="1", Wrap=True)
item_3 = ListItem(List=srf_cp.Point, Index="2", Wrap=True)
item_4 = ListItem(List=srf_cp.Point, Index="3", Wrap=True)
item_5 = ListItem(List=srf_cp.Point, Index="4", Wrap=True)
item_6 = ListItem(List=srf_cp.Point, Index="5", Wrap=True)
item_7 = ListItem(List=srf_cp.Point, Index="6", Wrap=True)
item_8 = ListItem(List=srf_cp.Point, Index="7", Wrap=True)
geo = ClusterOutput(orient.Geometry)
_1 = ClusterOutput(item)
_2 = ClusterOutput(item_2)
_3 = ClusterOutput(item_3)
_4 = ClusterOutput(item_4)
_8 = ClusterOutput(item_8)
_5 = ClusterOutput(item_5)
_6 = ClusterOutput(item_6)
_7 = ClusterOutput(item_7)
cloud = ClusterOutput(srf_cp.Point)

# ==== cluster LED
number_slider = Slider(0.5, range=0..10)
neg = Negative(Value=number_slider)
guide_srf = ClusterInput()
location = ClusterInput()
rotation = ClusterInput()
brep = Brep([<brep referenced from the Rhino model> x3])
pt = Point([<point referenced from the Rhino model> x2])
Y = UnitY(Factor=[neg, number_slider])
pt_2 = Point(location)
srf = Surface(guide_srf)
move = Move(Geometry=pt, Motion=Y)  # -> Geometry, Transform
panel = Panel(move.Geometry)
number_slider_2 = Slider(90, range=0..1000)
brep_cp = BrepClosestPoint(Point=pt_2, Brep=srf)  # -> Point, Normal, Distance
rad = Radians(Degrees=rotation)
pl = PlaneNormal(Origin=brep_cp.Point, ZAxis=brep_cp.Normal)
rotate = Rotate(Geometry=pl, Angle=rad, Plane=pl)  # -> Geometry, Transform
amp = Amplitude(Vector=brep_cp.Normal, Amplitude=Slider(2, range=0..10))
colour = ColourPicker(PickedColour=RGBA(255, 66, 66, 213))

# ---- group: Centre of Pins
shift = ShiftList(List=move.Geometry, Shift=1, Wrap=True)
ln = Line(StartPoint=move.Geometry, EndPoint=shift)

# ----
item = ListItem(List=ln, Index=0, Wrap=True)
panel_2 = Panel(item)

# ---- group: Centre of Pins (continued)
pcen = PolygonCenter(Polyline=item)  # -> CenterV, CenterE, CenterA

# ----
orient = Orient(Geometry=move.Geometry, Source=pcen.CenterV, Target=rotate.Geometry)  # -> Geometry, Transform
srf_cp = SurfaceClosestPoint(Point=orient.Geometry, Surface=srf)  # -> Point, UVPoint, Distance
orient_2 = Orient(Geometry=brep, Source=pcen.CenterV, Target=rotate.Geometry)  # -> Geometry, Transform
move_2 = Move(Geometry=srf_cp.Point, Motion=amp)  # -> Geometry, Transform
preview = CustomPreview(
    Geometry=orient_2.Geometry,
    Material={diffuse=RGB(221, 160, 221), emission=RGB(66, 48, 66), shine=0.5, specular=RGB(255, 255, 255), transparency=0})
item_2 = ListItem(List=srf_cp.Point, Index="0", Wrap=True)
item_3 = ListItem(List=move_2.Geometry, Index="1", Wrap=True)
item_4 = ListItem(List=move_2.Geometry, Index=0, Wrap=True)
item_5 = ListItem(List=srf_cp.Point, Index="1", Wrap=True)
preview_2 = ClusterOutput(item_4)
geo = ClusterOutput(orient_2.Geometry)
preview_3 = ClusterOutput(item_3)
x = ClusterOutput(item_2)
x_2 = ClusterOutput(item_5)
cloud = ClusterOutput(srf_cp.Point)
sph = Sphere(Base=srf_cp.Point, Radius=Slider(0.1, range=0..1))
preview_4 = CustomPreview(Geometry=sph, Material=colour)

# ==== cluster INTERCONNECT
underlying_grid = ClusterInput()
grid_pitch_prox = ClusterInput()
fp = ClusterInput()
surface = ClusterInput()
ap = ClusterInput()
bp = ClusterInput()
fp_2 = ClusterInput()
fp_3 = ClusterInput()
fp_4 = ClusterInput()
fp_5 = ClusterInput()
fp_6 = ClusterInput()
cp = ClusterInput()
ep = ClusterInput()
fp_7 = ClusterInput()
dp = ClusterInput()
path_planning = PathPlanning(V=bp)
path_planning_2 = PathPlanning(V=ap)
path_planning_3 = PathPlanning_2(V=fp)
path_planning_4 = PathPlanning_2(V=fp_2)
path_planning_5 = PathPlanning_2(V=fp_3)
path_planning_6 = PathPlanning_2(V=fp_4)
path_planning_7 = PathPlanning_2(V=fp_5)
path_planning_8 = PathPlanning_2(V=fp_6)
path_planning_9 = PathPlanning(V=cp)
path_planning_10 = PathPlanning_2(V=ep)
path_planning_11 = PathPlanning_2(V=fp_7)
path_planning_12 = PathPlanning(V=dp)
shortwalk = ShortestWalk(Curves=underlying_grid, WantedPath=path_planning_2)  # -> ShortestWalk, Succession, Direction, Length
shortwalk_2 = ShortestWalk(Curves=underlying_grid, WantedPath=path_planning_3)  # -> ShortestWalk, Succession, Direction, Length
shortwalk_3 = ShortestWalk(Curves=underlying_grid, WantedPath=path_planning_4)  # -> ShortestWalk, Succession, Direction, Length
shortwalk_4 = ShortestWalk(Curves=underlying_grid, WantedPath=path_planning_5)  # -> ShortestWalk, Succession, Direction, Length
shortwalk_5 = ShortestWalk(Curves=underlying_grid, WantedPath=path_planning_6)  # -> ShortestWalk, Succession, Direction, Length
shortwalk_6 = ShortestWalk(Curves=underlying_grid, WantedPath=path_planning_7)  # -> ShortestWalk, Succession, Direction, Length
shortwalk_7 = ShortestWalk(Curves=underlying_grid, WantedPath=path_planning_8)  # -> ShortestWalk, Succession, Direction, Length
shortwalk_8 = ShortestWalk(Curves=underlying_grid, WantedPath=path_planning)  # -> ShortestWalk, Succession, Direction, Length
shortwalk_9 = ShortestWalk(Curves=underlying_grid, WantedPath=path_planning_11)  # -> ShortestWalk, Succession, Direction, Length
shortwalk_10 = ShortestWalk(Curves=underlying_grid, WantedPath=path_planning_9)  # -> ShortestWalk, Succession, Direction, Length
shortwalk_11 = ShortestWalk(Curves=underlying_grid, WantedPath=path_planning_10)  # -> ShortestWalk, Succession, Direction, Length
shortwalk_12 = ShortestWalk(Curves=underlying_grid, WantedPath=path_planning_12)  # -> ShortestWalk, Succession, Direction, Length
join = JoinCurves(Curves=shortwalk_8.ShortestWalk, Preserve=False)
join_2 = JoinCurves(Curves=shortwalk_10.ShortestWalk, Preserve=False)
join_3 = JoinCurves(Curves=shortwalk.ShortestWalk, Preserve=False)
join_4 = JoinCurves(Curves=shortwalk_2.ShortestWalk, Preserve=False)
join_5 = JoinCurves(Curves=shortwalk_3.ShortestWalk, Preserve=False)
join_6 = JoinCurves(Curves=shortwalk_4.ShortestWalk, Preserve=False)
join_7 = JoinCurves(Curves=shortwalk_5.ShortestWalk, Preserve=False)
join_8 = JoinCurves(Curves=shortwalk_6.ShortestWalk, Preserve=False)
join_9 = JoinCurves(Curves=shortwalk_7.ShortestWalk, Preserve=False)
explode = Explode(Curve=join, Recursive=True)  # -> Segments, Vertices
explode_2 = Explode(Curve=join_2, Recursive=True)  # -> Segments, Vertices
explode_3 = Explode(Curve=join_3, Recursive=True)  # -> Segments, Vertices
join_10 = JoinCurves(Curves=shortwalk_11.ShortestWalk, Preserve=False)
join_11 = JoinCurves(Curves=shortwalk_9.ShortestWalk, Preserve=False)
join_12 = JoinCurves(Curves=shortwalk_12.ShortestWalk, Preserve=False)
explode_4 = Explode(Curve=join_4, Recursive=True)  # -> Segments, Vertices
explode_5 = Explode(Curve=join_5, Recursive=True)  # -> Segments, Vertices
explode_6 = Explode(Curve=join_6, Recursive=True)  # -> Segments, Vertices
explode_7 = Explode(Curve=join_7, Recursive=True)  # -> Segments, Vertices
explode_8 = Explode(Curve=join_8, Recursive=True)  # -> Segments, Vertices
explode_9 = Explode(Curve=join_9, Recursive=True)  # -> Segments, Vertices
pline = PolyLine(Vertices=explode.Vertices, Closed=False)
explode_10 = Explode(Curve=join_10, Recursive=True)  # -> Segments, Vertices
pline_2 = PolyLine(Vertices=explode_2.Vertices, Closed=False)
explode_11 = Explode(Curve=join_11, Recursive=True)  # -> Segments, Vertices
pline_3 = PolyLine(Vertices=explode_3.Vertices, Closed=False)
explode_12 = Explode(Curve=join_12, Recursive=True)  # -> Segments, Vertices
pline_4 = PolyLine(Vertices=explode_4.Vertices, Closed=False)
pline_5 = PolyLine(Vertices=explode_5.Vertices, Closed=False)
pline_6 = PolyLine(Vertices=explode_6.Vertices, Closed=False)
pline_7 = PolyLine(Vertices=explode_7.Vertices, Closed=False)
pline_8 = PolyLine(Vertices=explode_8.Vertices, Closed=False)
pline_9 = PolyLine(Vertices=explode_9.Vertices, Closed=False)
pline_10 = PolyLine(Vertices=explode_10.Vertices, Closed=False)
pline_11 = PolyLine(Vertices=explode_11.Vertices, Closed=False)
pline_12 = PolyLine(Vertices=explode_12.Vertices, Closed=False)
pull = PullCurve(Curve=pline_4, Surface=surface)
pull_2 = PullCurve(Curve=pline_5, Surface=surface)
pull_3 = PullCurve(Curve=pline_6, Surface=surface)
pull_4 = PullCurve(Curve=pline_7, Surface=surface)
pull_5 = PullCurve(Curve=pline_8, Surface=surface)
pull_6 = PullCurve(Curve=pline_3, Surface=surface)
pull_7 = PullCurve(Curve=pline, Surface=surface)
pull_8 = PullCurve(Curve=pline_9, Surface=surface)
pull_9 = PullCurve(Curve=pline_12, Surface=surface)
pull_10 = PullCurve(Curve=pline_2, Surface=surface)
pull_11 = PullCurve(Curve=pline_10, Surface=surface)
pull_12 = PullCurve(Curve=pline_11, Surface=surface)
midpt = CurveMiddle()
midpt_2 = CurveMiddle()
midpt_3 = CurveMiddle()
midpt_4 = CurveMiddle()
midpt_5 = CurveMiddle()
midpt_6 = CurveMiddle()
midpt_7 = CurveMiddle()
midpt_8 = CurveMiddle()
midpt_9 = CurveMiddle()
midpt_10 = CurveMiddle()
midpt_11 = CurveMiddle()
c_script = CSharpScript(T="6", P=midpt)  # -> out, A; inputs T: String, P: Point3d
# ---------- c_script: C# usings ----------
using System.IO;
using System.Linq;
using System.Data;
using System.Drawing;
using System.Reflection;
using System.Windows.Forms;
using System.Xml;
using System.Xml.Linq;
using System.Runtime.InteropServices;

using Rhino.DocObjects;
using Rhino.Collections;
using GH_IO;
using GH_IO.Serialization;
# ---------- c_script: C# ----------
    _text.Add(T);
    _points.Add(P);
# ---------- c_script: C# additional code ----------
  private readonly List<string> _text = new List<string>();
  private readonly List<Point3d> _points = new List<Point3d>();

  /// <summary>
  /// This method will be called once every solution, before any calls to RunScript.
  /// </summary>
  public override void BeforeRunScript()
  {
    _text.Clear();
    _points.Clear();
  }

  //Draw all meshes in this method.
  public override void DrawViewportMeshes(IGH_PreviewArgs args)
  {
    for (int i = 0; i < _text.Count; i++)
    {
      Plane plane ;
      args.Viewport.GetCameraFrame(out plane);
      plane.Origin = _points[i];

      args.Display.Draw3dText(_text[i], Color.Black, plane, 1.5, "Lucida Console");
    }
  }
# ---------- end c_script ----------
c_script_2 = CSharpScript(T="6", P=midpt_2)  # -> out, A; inputs T: String, P: Point3d; same code as c_script
c_script_3 = CSharpScript(T="6", P=midpt_3)  # -> out, A; inputs T: String, P: Point3d; same code as c_script
c_script_4 = CSharpScript(T="6", P=midpt_4)  # -> out, A; inputs T: String, P: Point3d; same code as c_script
c_script_5 = CSharpScript(T="6", P=midpt_5)  # -> out, A; inputs T: String, P: Point3d; same code as c_script
c_script_6 = CSharpScript(T="6", P=midpt_6)  # -> out, A; inputs T: String, P: Point3d; same code as c_script
midpt_12 = CurveMiddle()
c_script_7 = CSharpScript(T="5", P=midpt_7)  # -> out, A; inputs T: String, P: Point3d; same code as c_script
c_script_8 = CSharpScript(T="6", P=midpt_8)  # -> out, A; inputs T: String, P: Point3d; same code as c_script
c_script_9 = CSharpScript(T="4", P=midpt_9)  # -> out, A; inputs T: String, P: Point3d; same code as c_script
c_script_10 = CSharpScript(T="1", P=midpt_12)  # -> out, A; inputs T: String, P: Point3d
# ---------- c_script_10: C# ----------
    _text.Add(T);
    _points.Add(P);
# ---------- c_script_10: C# additional code ----------
  private readonly List<string> _text = new List<string>();
  private readonly List<Point3d> _points = new List<Point3d>();

  /// <summary>
  /// This method will be called once every solution, before any calls to RunScript.
  /// </summary>
  public override void BeforeRunScript()
  {
    _text.Clear();
    _points.Clear();
  }

  //Draw all meshes in this method.
  public override void DrawViewportMeshes(IGH_PreviewArgs args)
  {
    for (int i = 0; i < _text.Count; i++)
    {
      Plane plane ;
      args.Viewport.GetCameraFrame(out plane);
       plane.Origin = _points[i];

      args.Display.Draw3dText(_text[i], Color.Black, plane, 1.5, "Lucida Console");
    }
  }
# ---------- end c_script_10 ----------
c_script_11 = CSharpScript(T="3", P=midpt_11)  # -> out, A; inputs T: String, P: Point3d; same code as c_script
c_script_12 = CSharpScript(T="2", P=midpt_10)  # -> out, A; inputs T: String, P: Point3d
# ---------- c_script_12: C# ----------
    _text.Add(T);
    _points.Add(P);
# ---------- c_script_12: C# additional code ----------
  private readonly List<string> _text = new List<string>();
  private readonly List<Point3d> _points = new List<Point3d>();

  /// <summary>
  /// This method will be called once every solution, before any calls to RunScript.
  /// </summary>
  public override void BeforeRunScript()
  {
    _text.Clear();
    _points.Clear();
  }

  //Draw all meshes in this method.
  public override void DrawViewportMeshes(IGH_PreviewArgs args)
  {
    for (int i = 0; i < _text.Count; i++)
    {
      Plane plane ;
      args.Viewport.GetCameraFrame(out plane);
         plane.Origin = _points[i];

      args.Display.Draw3dText(_text[i], Color.Black, plane, 1.5, "Lucida Console");
    }
  }
# ---------- end c_script_12 ----------
D = ClusterOutput(pull)
D_2 = ClusterOutput(pull_2)
D_3 = ClusterOutput(pull_3)
D_4 = ClusterOutput(pull_4)
D_5 = ClusterOutput(pull_5)
D_6 = ClusterOutput(pull_8)
C = ClusterOutput(pull_10)
D_7 = ClusterOutput(pull_11)
D_8 = ClusterOutput(pull_12)
A = ClusterOutput(pull_6)  # A
B = ClusterOutput(pull_7)
D_9 = ClusterOutput(pull_9)

# ==== cluster Cluster
P = ClusterInput()
G = ClusterInput()
M = ClusterInput()
points = PointList(Points=P, Size=Slider(1.5, range=0..10))
preview = CustomPreview(Geometry=G, Material=M)

# ==== cluster JST
guide_srf = ClusterInput()
rotation = ClusterInput()
location = ClusterInput()
brep = Brep([<brep referenced from the Rhino model> x3])
pt = Point([<point referenced from the Rhino model> x2])
pt_2 = Point([<point referenced from the Rhino model> x2])
pt_3 = Point(location)
srf = Surface(guide_srf)

# ---- group: Centre of Pins
shift = ShiftList(List=pt, Shift=1, Wrap=True)
ln = Line(StartPoint=pt, EndPoint=shift)
join = JoinCurves(Curves=ln, Preserve=False)
pcen = PolygonCenter(Polyline=join)  # -> CenterV, CenterE, CenterA

# ----
number_slider = Slider(90, range=0..1000)
brep_cp = BrepClosestPoint(Point=pt_3, Brep=srf)  # -> Point, Normal, Distance
rad = Radians(Degrees=rotation)
pl = PlaneNormal(Origin=brep_cp.Point, ZAxis=brep_cp.Normal)
rotate = Rotate(Geometry=pl, Angle=rad, Plane=pl)  # -> Geometry, Transform
orient = Orient(Geometry=pt_2, Source=pcen.CenterV, Target=rotate.Geometry)  # -> Geometry, Transform
srf_cp = SurfaceClosestPoint(Point=orient.Geometry, Surface=srf)  # -> Point, UVPoint, Distance
orient_2 = Orient(Geometry=brep, Source=pcen.CenterV, Target=rotate.Geometry)  # -> Geometry, Transform
item = ListItem(List=srf_cp.Point, Index="0", Wrap=True)
item_2 = ListItem(List=srf_cp.Point, Index="1", Wrap=True)
c_script = CSharpScript(T="+", P=item)  # -> out, A; inputs T: String, P: Point3d; same code as c_script
c_script_2 = CSharpScript(T="-", P=item_2)  # -> out, A; inputs T: String, P: Point3d; same code as c_script
geo = ClusterOutput(orient_2.Geometry)
x = ClusterOutput(item)
x_2 = ClusterOutput(item_2)
cloud = ClusterOutput(srf_cp.Point)

# ==== cluster PathPlanning
V = ClusterInput()
pt1 = ClusterInput()
pt2 = ClusterInput()
pt = Point(flatten(pt2))
pt_2 = Point(flatten(pt1))

pline = PolyLine(Vertices=V, Closed=False)
end = EndPoints(Curve=pline)  # -> Start, End
ln = Line(StartPoint=pt_2, EndPoint=end.Start)
ln_2 = Line(StartPoint=end.End, EndPoint=pt)
ln_3 = Line(StartPoint=pt_2, EndPoint=pt)
explode = Explode(Curve=[ln_2, ln, pline], Recursive=True)  # -> simplify(flatten(Segments)), Vertices
lng = ListLength(List=flatten(explode.Segments))  # -> flatten(Length)
null = NullItem(Item=lng)  # -> NullFlags, InvalidFlags, Description
bool = Boolean(invert(null.NullFlags))

panel = Panel(pt_2)
panel_2 = Panel(pt)
filter = StreamFilter(Gate=bool, Stream0=ln_3, Stream1=explode.Segments)
item = ListItem(List=filter, Index=Slider(1, range=0..1), Wrap=True)
panel_3 = Panel(filter)
s_1 = ClusterOutput(filter)

# ==== cluster PathPlanning_2
V = ClusterInput()
pt1 = ClusterInput()
pt2 = ClusterInput()
pt = Point(flatten(pt2))
pt_2 = Point(flatten(pt1))

pline = PolyLine(Vertices=V, Closed=False)
end = EndPoints(Curve=pline)  # -> Start, End
ln = Line(StartPoint=pt_2, EndPoint=end.Start)
ln_2 = Line(StartPoint=end.End, EndPoint=pt)
ln_3 = Line(StartPoint=pt_2, EndPoint=pt)
explode = Explode(Curve=[ln_2, ln, pline], Recursive=True)  # -> simplify(flatten(Segments)), Vertices
lng = ListLength(List=flatten(explode.Segments))  # -> flatten(Length)
null = NullItem(Item=lng)  # -> NullFlags, InvalidFlags, Description
bool = Boolean(invert(null.NullFlags))

panel = Panel(pt_2)
panel_2 = Panel(pt)
filter = StreamFilter(Gate=bool, Stream0=ln_3, Stream1=explode.Segments)
item = ListItem(List=filter, Index=Slider(1, range=0..1), Wrap=True)
panel_3 = Panel(filter)
s_0 = ClusterOutput(filter)
