# Grasshopper definition TCB_Design_Editor.gh (Grasshopper 1.0.7)
# plug-ins: Heteroptera, Human UI

pitch_dimension = Slider(4, range=1..5)
pickbtn = CreateRhinoPickButton(ButtonName="  JST  ", Prompt="Please select geometry...", AllowMultiple=True, AllowNone=True, Type=0, ButtonStyle=0)
colour = ColourPicker(PickedColour=RGB(255, 186, 186))
colour_2 = ColourPicker(PickedColour=RGB(255, 255, 255))
colour_3 = ColourPicker(PickedColour=RGB(220, 210, 250))
colour_4 = ColourPicker(PickedColour=RGBA(79, 79, 79, 123))

button = CreateButton(ButtonName="reset", ButtonStyle=0)
values = ValueListener(Elements=button, SomeProperty=True)  # -> Values, Indices
pickbtn_2 = CreateRhinoPickButton(ButtonName="8", Prompt="Please select geometry...", AllowMultiple=True, AllowNone=values.Values, Type=0, ButtonStyle=0)
values_2 = ValueListener(Elements=pickbtn_2, SomeProperty=True)  # -> Values, Indices
stack = CreateStack(UIElements=[pickbtn_2, button], Horizontal=True)

# ---- group: 2
button_2 = CreateButton(ButtonName="reset", ButtonStyle=0)
values_3 = ValueListener(Elements=button_2, SomeProperty=True)  # -> Values, Indices
pickbtn_3 = CreateRhinoPickButton(ButtonName="2", Prompt="Please select geometry...", AllowMultiple=True, AllowNone=values_3.Values, Type=0, ButtonStyle=0)
values_4 = ValueListener(Elements=pickbtn_3, SomeProperty=True)  # -> Values, Indices
stack_2 = CreateStack(UIElements=[pickbtn_3, button_2], Horizontal=True)

# ----
button_3 = CreateButton(ButtonName="reset", ButtonStyle=0)
values_5 = ValueListener(Elements=button_3, SomeProperty=True)  # -> Values, Indices
pickbtn_4 = CreateRhinoPickButton(ButtonName="9", Prompt="Please select geometry...", AllowMultiple=True, AllowNone=values_5.Values, Type=0, ButtonStyle=0)
values_6 = ValueListener(Elements=pickbtn_4, SomeProperty=True)  # -> Values, Indices
stack_3 = CreateStack(UIElements=[pickbtn_4, button_3], Horizontal=True)

button_4 = CreateButton(ButtonName="reset", ButtonStyle=0)
values_7 = ValueListener(Elements=button_4, SomeProperty=True)  # -> Values, Indices
pickbtn_5 = CreateRhinoPickButton(
    ButtonName="10",
    Prompt="Please select geometry...",
    AllowMultiple=True,
    AllowNone=values_7.Values,
    Type=0,
    ButtonStyle=0)
values_8 = ValueListener(Elements=pickbtn_5, SomeProperty=True)  # -> Values, Indices
stack_4 = CreateStack(UIElements=[pickbtn_5, button_4], Horizontal=True)

# ---- group: 3
button_5 = CreateButton(ButtonName="reset", ButtonStyle=0)
values_9 = ValueListener(Elements=button_5, SomeProperty=True)  # -> Values, Indices
pickbtn_6 = CreateRhinoPickButton(ButtonName="3", Prompt="Please select geometry...", AllowMultiple=True, AllowNone=values_9.Values, Type=0, ButtonStyle=0)
values_10 = ValueListener(Elements=pickbtn_6, SomeProperty=True)  # -> Values, Indices
stack_5 = CreateStack(UIElements=[pickbtn_6, button_5], Horizontal=True)

# ---- group: 1
button_6 = CreateButton(ButtonName="Reset", ButtonStyle=0)
values_11 = ValueListener(Elements=button_6, SomeProperty=True)  # -> Values, Indices
pickbtn_7 = CreateRhinoPickButton(
    ButtonName="1",
    Prompt="Please select geometry...",
    AllowMultiple=True,
    AllowNone=values_11.Values,
    Type=0,
    ButtonStyle=0)
values_12 = ValueListener(Elements=pickbtn_7, SomeProperty=True)  # -> Values, Indices
stack_6 = CreateStack(UIElements=[pickbtn_7, button_6], Horizontal=True)

# ---- group: 4
button_7 = CreateButton(ButtonName="reset", ButtonStyle=0)
values_13 = ValueListener(Elements=button_7, SomeProperty=True)  # -> Values, Indices
pickbtn_8 = CreateRhinoPickButton(
    ButtonName="4",
    Prompt="Please select geometry...",
    AllowMultiple=True,
    AllowNone=values_13.Values,
    Type=0,
    ButtonStyle=0)
values_14 = ValueListener(Elements=pickbtn_8, SomeProperty=True)  # -> Values, Indices
stack_7 = CreateStack(UIElements=[pickbtn_8, button_7], Horizontal=True)

# ----
button_8 = CreateButton(ButtonName="reset", ButtonStyle=0)
values_15 = ValueListener(Elements=button_8, SomeProperty=True)  # -> Values, Indices
pickbtn_9 = CreateRhinoPickButton(
    ButtonName="7",
    Prompt="Please select geometry...",
    AllowMultiple=True,
    AllowNone=values_15.Values,
    Type=0,
    ButtonStyle=0)
values_16 = ValueListener(Elements=pickbtn_9, SomeProperty=True)  # -> Values, Indices
stack_8 = CreateStack(UIElements=[pickbtn_9, button_8], Horizontal=True)

button_9 = CreateButton(ButtonName="reset", ButtonStyle=0)
values_17 = ValueListener(Elements=button_9, SomeProperty=True)  # -> Values, Indices
pickbtn_10 = CreateRhinoPickButton(
    ButtonName="6",
    Prompt="Please select geometry...",
    AllowMultiple=True,
    AllowNone=values_17.Values,
    Type=0,
    ButtonStyle=0)
values_18 = ValueListener(Elements=pickbtn_10, SomeProperty=True)  # -> Values, Indices
stack_9 = CreateStack(UIElements=[pickbtn_10, button_9], Horizontal=True)

# ---- group: 5
button_10 = CreateButton(ButtonName="reset", ButtonStyle=0)
values_19 = ValueListener(Elements=button_10, SomeProperty=True)  # -> Values, Indices
pickbtn_11 = CreateRhinoPickButton(
    ButtonName="5",
    Prompt="Please select geometry...",
    AllowMultiple=True,
    AllowNone=values_19.Values,
    Type=0,
    ButtonStyle=0)
values_20 = ValueListener(Elements=pickbtn_11, SomeProperty=True)  # -> Values, Indices
stack_10 = CreateStack(UIElements=[pickbtn_11, button_10], Horizontal=True)

# ----
button_11 = CreateButton(ButtonName="reset", ButtonStyle=0)
values_21 = ValueListener(Elements=button_11, SomeProperty=True)  # -> Values, Indices
pickbtn_12 = CreateRhinoPickButton(
    ButtonName="6",
    Prompt="Please select geometry...",
    AllowMultiple=True,
    AllowNone=values_21.Values,
    Type=0,
    ButtonStyle=0)
values_22 = ValueListener(Elements=pickbtn_12, SomeProperty=True)  # -> Values, Indices
stack_11 = CreateStack(UIElements=[pickbtn_12, button_11], Horizontal=True)

# ---- group: Create UV grid
slider = CreateSlider(Slider=pitch_dimension, ShowBounds=False, ShowTicks=False, ShowTooltip=False, ShowValLabel=True, showLabel=True)
values_23 = ValueListener(Elements=slider, SomeProperty=True)  # -> PitchDimension, Indices

# ----
label = CreateLabel(LabelText=" ", LabelSize=12, Justification=0)
pt = Point(values_4.Values)

# ---- group: Place the components
series = Series(Start=0, Step=1, Count=10)
pulldown = CreatePulldownMenu(Label="Add Component", ListItems=series, showLabel=True)

# ----
button_12 = CreateButton(ButtonName="reset", ButtonStyle=0)

series_2 = Series(Start=0, Step=1, Count=Slider(11, range=0..100))
pulldown_2 = CreatePulldownMenu(Label="No. of Interconnect", ListItems=series_2, showLabel=True)
values_24 = ValueListener(Elements=pulldown_2, SomeProperty=True)  # -> Values, Indices
subtraction = Subtraction(A=values_24.Values, B="1")

values_25 = ValueListener(Elements=button_12, SomeProperty=True)  # -> Values, Indices

# ---- group: ADD Base Geometry!!
pickbtn_13 = CreateRhinoPickButton(
    ButtonName="ADD GEOMETRY",
    Prompt="Please select geometry...",
    AllowMultiple=True,
    AllowNone=values_25.Values,
    Type=0,
    ButtonStyle=0)
values_26 = ValueListener(Elements=pickbtn_13, SomeProperty=True)  # -> Values, Indices
brep = Brep(values_26.Values)
colour_5 = ColourPicker(PickedColour=RGBA(161, 148, 143, 133))
preview = CustomPreview(Geometry=brep, Material=colour_5)

# ----
brep_2 = Brep(brep)
cluster = Cluster_2(B=brep_2)  # -> top_surface, bottom_surface
_2d_surface_analysis = _2DSurfaceAnalysis(S=cluster.bottom_surface, pitch_dimension=values_23.PitchDimension)  # -> lines, flatten(nodes), no_of_nodes
preview_2 = CustomPreview(Geometry=cluster.bottom_surface, Material=colour)
preview_3 = CustomPreview(Geometry=cluster.top_surface, Material=colour_2)
stack_12 = CreateStack(UIElements=[pickbtn_13, button_12], Horizontal=True)

# ---- group: Add SOCKET
button_13 = CreateButton(ButtonName="Reset", ButtonStyle=0)
values_27 = ValueListener(Elements=button_13, SomeProperty=True)  # -> Values, Indices
pickbtn_14 = CreateRhinoPickButton(
    ButtonName="Add Sockets",
    Prompt="Please select geometry...",
    AllowMultiple=True,
    AllowNone=values_27.Values,
    Type=0,
    ButtonStyle=0)
values_28 = ValueListener(Elements=pickbtn_14, SomeProperty=True)  # -> Values, Indices
stack_13 = CreateStack(UIElements=[pickbtn_14, button_13], Horizontal=True)

# ---- group: 1
button_14 = CreateButton(ButtonName="Reset", ButtonStyle=0)
values_29 = ValueListener(Elements=button_14, SomeProperty=True)  # -> Values, Indices
pickbtn_15 = CreateRhinoPickButton(
    ButtonName="Add Vias!",
    Prompt="Please select geometry...",
    AllowMultiple=True,
    AllowNone=values_29.Values,
    Type=0,
    ButtonStyle=0)
values_30 = ValueListener(Elements=pickbtn_15, SomeProperty=True)  # -> Values, Indices
stack_14 = CreateStack(UIElements=[pickbtn_15, button_14], Horizontal=True)

# ----
socket_height = Slider(2, range=0..3)
socket_radius = Slider(1, range=0..3)
slider_2 = CreateSlider(Slider=socket_height, ShowBounds=False, ShowTicks=False, ShowTooltip=False, ShowValLabel=True, showLabel=True)
slider_3 = CreateSlider(Slider=socket_radius, ShowBounds=False, ShowTicks=False, ShowTooltip=False, ShowValLabel=True, showLabel=True)
toggle = CreateToggle(Default=Toggle(False), Label="Export Substrate")

# ----
# 2nd Window
interconnect_width = Slider(1.5, range=0.2..1.5)
interconnect_height = Slider(0.5, range=0..1)
slider_4 = CreateSlider(Slider=interconnect_width, ShowBounds=False, ShowTicks=False, ShowTooltip=False, ShowValLabel=True, showLabel=True)
values_31 = ValueListener(Elements=slider_4, SomeProperty=True)  # -> Values, Indices
slider_5 = CreateSlider(Slider=interconnect_height, ShowBounds=False, ShowTicks=False, ShowTooltip=False, ShowValLabel=True, showLabel=True)
values_32 = ValueListener(Elements=slider_5, SomeProperty=True)  # -> Values, Indices
stack_15 = CreateStack(UIElements=[slider_4, slider_5, toggle], Horizontal=False)  # -> flatten(Stack)

values_33 = ValueListener(Elements=slider_3, SomeProperty=True)  # -> PitchDimension, Indices
values_34 = ValueListener(Elements=slider_2, SomeProperty=True)  # -> PitchDimension, Indices
values_35 = ValueListener(Elements=toggle, SomeProperty=True)  # -> Values, Indices
hole_radius = Slider(1, range=0..3)
stack_16 = CreateStack(UIElements=[slider_3, slider_2], Horizontal=True)
slider_6 = CreateSlider(Slider=hole_radius, ShowBounds=False, ShowTicks=False, ShowTooltip=False, ShowValLabel=True, showLabel=True)
values_36 = ValueListener(Elements=slider_6, SomeProperty=True)  # -> PitchDimension, Indices

# ---- group: Draw Vias
number_slider = Slider(2, range=0..10)
pl = ConstructPlane(Origin=values_30.Values, XAxis=Vector(1, 0, 0), YAxis=Vector(0, 1, 0))
neg = Negative(Value=Slider(5, range=0..10))
cyl = Cylinder(Base=pl, Radius=values_36.PitchDimension, Length=neg)
edges = BrepEdges(Brep=cyl)  # -> Naked, Interior, NonManifold
item = ListItem(List=edges.Naked, Index=Slider(1, range=0..1), Wrap=True)

# ----
pl_2 = ConstructPlane(Origin=values_28.Values, XAxis=Vector(1, 0, 0), YAxis=Vector(0, 1, 0))
division = Division(A=values_36.PitchDimension, B=Slider(2, range=0..10))
cyl_2 = Cylinder(Base=pl_2, Radius=values_33.PitchDimension, Length=values_34.PitchDimension)
cap = CapHoles(Brep=cyl_2)
multiplication = Multiplication(A=division, B=Slider(2, range=0..10))

rotation = Slider(360, range=0..360)

# ---- group: 555 / 555 Rotation
slider_7 = CreateSlider(Slider=rotation, ShowBounds=False, ShowTicks=False, ShowTooltip=False, ShowValLabel=True, showLabel=True)
values_37 = ValueListener(Elements=slider_7, SomeProperty=True)  # -> Values, Indices

# ---- group: 555
pickbtn_16 = CreateRhinoPickButton(ButtonName="555 IC", Prompt="Please select geometry...", AllowMultiple=False, AllowNone=True, Type=0, ButtonStyle=0)
toggle_2 = CreateToggle(Default=Toggle(True))
values_38 = ValueListener(Elements=pickbtn_16, SomeProperty=True)  # -> Values, Indices
values_39 = ValueListener(Elements=toggle_2, SomeProperty=True)  # -> Values, Indices
stack_17 = CreateStack(UIElements=[pickbtn_16, slider_7, toggle_2], Horizontal=True)
gate = StreamGate(Stream=values_38.Values, Gate=values_39.Values)  # -> Target0, Target1

# ----
rotation_2 = Slider(360, range=0..360)

# ---- group: LED_1
toggle_3 = BooleanToggle(True)
pickbtn_17 = CreateRhinoPickButton(ButtonName="LED_1", Prompt="Please select geometry...", AllowMultiple=False, AllowNone=True, Type=0, ButtonStyle=0)
toggle_4 = CreateToggle(Default=toggle_3)
values_40 = ValueListener(Elements=pickbtn_17, SomeProperty=True)  # -> Values, Indices
slider_8 = CreateSlider(Slider=rotation_2, ShowBounds=False, ShowTicks=False, ShowTooltip=False, ShowValLabel=True, showLabel=True)
values_41 = ValueListener(Elements=slider_8, SomeProperty=True)  # -> Values, Indices
values_42 = ValueListener(Elements=toggle_4, SomeProperty=True)  # -> Values, Indices
stack_18 = CreateStack(UIElements=[pickbtn_17, slider_8, toggle_4], Horizontal=True)
gate_2 = StreamGate(Stream=values_40.Values, Gate=values_42.Values)  # -> Target0, Target1

# ----
rotation_3 = Slider(360, range=0..360)

# ---- group: led_2
pickbtn_18 = CreateRhinoPickButton(ButtonName="LED_3", Prompt="Please select geometry...", AllowMultiple=False, AllowNone=True, Type=0, ButtonStyle=0)
toggle_5 = CreateToggle(Default=Toggle(True))
slider_9 = CreateSlider(Slider=rotation_3, ShowBounds=False, ShowTicks=False, ShowTooltip=False, ShowValLabel=True, showLabel=True)
values_43 = ValueListener(Elements=pickbtn_18, SomeProperty=True)  # -> Values, Indices
values_44 = ValueListener(Elements=slider_9, SomeProperty=True)  # -> Values, Indices
values_45 = ValueListener(Elements=toggle_5, SomeProperty=True)  # -> Values, Indices
stack_19 = CreateStack(UIElements=[pickbtn_18, slider_9, toggle_5], Horizontal=True)
gate_3 = StreamGate(Stream=values_43.Values, Gate=values_45.Values)  # -> Target0, Target1

# ----
rotation_4 = Slider(360, range=0..360)

# ---- group: JST
toggle_6 = CreateToggle(Default=Toggle(True))
slider_10 = CreateSlider(Slider=rotation_4, ShowBounds=False, ShowTicks=False, ShowTooltip=False, ShowValLabel=True, showLabel=True)
values_46 = ValueListener(Elements=slider_10, SomeProperty=True)  # -> Values, Indices
values_47 = ValueListener(Elements=pickbtn, SomeProperty=True)  # -> Values, Indices
values_48 = ValueListener(Elements=toggle_6, SomeProperty=True)  # -> Values, Indices
stack_20 = CreateStack(UIElements=[pickbtn, slider_10, toggle_6], Horizontal=True)
gate_4 = StreamGate(Stream=values_47.Values, Gate=values_48.Values)  # -> Target0, Target1

# ---- group: led_2
pickbtn_19 = CreateRhinoPickButton(ButtonName="LED_2", Prompt="Please select geometry...", AllowMultiple=False, AllowNone=True, Type=0, ButtonStyle=0)
toggle_7 = CreateToggle(Default=Toggle(True))
values_49 = ValueListener(Elements=pickbtn_19, SomeProperty=True)  # -> Values, Indices
slider_11 = CreateSlider(Slider=rotation_4, ShowBounds=False, ShowTicks=False, ShowTooltip=False, ShowValLabel=True, showLabel=True)
values_50 = ValueListener(Elements=slider_11, SomeProperty=True)  # -> Values, Indices
values_51 = ValueListener(Elements=toggle_7, SomeProperty=True)  # -> Values, Indices
stack_21 = CreateStack(UIElements=[pickbtn_19, slider_11, toggle_7], Horizontal=True)
gate_5 = StreamGate(Stream=values_49.Values, Gate=values_51.Values)  # -> Target0, Target1

# ----
merge = Merge(Data2=stack_18, Data3=stack_21, Data4=stack_19, Data5=stack_20)

# ---- group: Place the components
label_2 = CreateLabel(LabelText="Place the components", LabelSize=24, Justification=0)
merge_2 = Merge(Data1=label_2, Data3=merge)  # -> flatten(Result)

# ---- group: POWER
jst = JST(location=gate_4.Target1, rotation=values_46.Values)  # -> geo, cloud, x, x_2
graft = GraftTree(Tree=jst.cloud, IncludeEmptyLists=True, IncludeNullItems=True)
qb = QuickBaker(Geometry=graft, Bake=values_48.Values, referenceAll=1)

# ----
gate_6 = StreamGate(Stream=jst.geo, Gate=0)  # -> Target0, Target1
colour_6 = ColourPicker(PickedColour=RGBA(204, 199, 169, 187))
preview_4 = CustomPreview(Geometry=gate_6.Target0, Material=colour_6)

led = LED(location=gate_3.Target1, rotation=values_44.Values)  # -> geo, cloud, x, x_2, preview_2, preview_3
pt_2 = Point(graft(led.cloud))
qb_2 = QuickBaker(Geometry=pt_2, Bake=values_45.Values, referenceAll=1)

led_2 = LED(location=gate_5.Target1, rotation=values_50.Values)  # -> geo, cloud, x, x_2, preview_2, preview_3
pt_3 = Point(graft(led_2.cloud))
qb_3 = QuickBaker(Geometry=pt_3, Bake=values_51.Values, referenceAll=1)

led_3 = LED(location=gate_2.Target1, rotation=values_41.Values)  # -> geo, cloud, x, x_2, preview_2, preview_3
pt_4 = Point(graft(led_3.cloud))
qb_4 = QuickBaker(Geometry=pt_4, Bake=[toggle_3, values_42.Values], referenceAll=1)

relay = Relay([led_3.preview_3, led_2.preview_3, jst.x_2])
relay_2 = Relay([led_3.preview_2, led_2.preview_2, jst.x])
gate_7 = StreamGate(Stream=relay, Gate=0)  # -> Target0, Target1
gate_8 = StreamGate(Stream=relay_2, Gate=0)  # -> Target0, Target1
gate_9 = StreamGate(Stream=[led_2.geo, led_3.geo, led.geo], Gate=0)  # -> Target0, Target1
c_script = CSharpScript(T="+", P=gate_8.Target0)  # -> out, A; inputs T: String, P: Point3d; same code as c_script
c_script_2 = CSharpScript(T="-", P=gate_7.Target0)  # -> out, A; inputs T: String, P: Point3d; same code as c_script
colour_7 = ColourPicker(PickedColour=RGBA(84, 217, 17, 146))
preview_5 = CustomPreview(Geometry=gate_9.Target0, Material=colour_7)

# ----
# Construct Pitch Grid
_2d_surface_analysis_2 = _2DSurfaceAnalysis(S=cluster.top_surface, pitch_dimension=values_23.PitchDimension)  # -> lines, flatten(nodes), no_of_nodes

# ---- group: POWER (continued)
cps = ClosestPoints(Point=jst.cloud, Cloud=_2d_surface_analysis_2.nodes, Count=Slider(8, range=0..10))  # -> ClosestPoint, CPIndex, Distance
ln = Line(StartPoint=graft, EndPoint=cps.ClosestPoint)

# ----
cps_2 = ClosestPoints(Point=led.cloud, Cloud=[_2d_surface_analysis_2.nodes, _2d_surface_analysis.lines], Count=Slider(8, range=0..10))  # -> ClosestPoint, CPIndex, Distance
ln_2 = Line(StartPoint=pt_2, EndPoint=cps_2.ClosestPoint)

cps_3 = ClosestPoints(
    Point=led_3.cloud,
    Cloud=simplify(flatten([_2d_surface_analysis_2.nodes, _2d_surface_analysis.nodes])),
    Count=Slider(8, range=0..10))  # -> ClosestPoint, CPIndex, Distance
ln_3 = Line(StartPoint=pt_4, EndPoint=cps_3.ClosestPoint)

cps_4 = ClosestPoints(Point=led_2.cloud, Cloud=[_2d_surface_analysis_2.nodes, _2d_surface_analysis.lines], Count=Slider(8, range=0..10))  # -> ClosestPoint, CPIndex, Distance
ln_4 = Line(StartPoint=pt_3, EndPoint=cps_4.ClosestPoint)

_555 = _555(location=gate.Target1, rotation=values_37.Values)  # -> geo, cloud, _1, _2, _3, _4, _5, _6, _7, _8
cps_5 = ClosestPoints(Point=_555.cloud, Cloud=[_2d_surface_analysis_2.nodes, _2d_surface_analysis.nodes], Count=Slider(8, range=0..10))  # -> ClosestPoint, CPIndex, Distance
pt_5 = Point(graft(_555.cloud))
ln_5 = Line(StartPoint=pt_5, EndPoint=cps_5.ClosestPoint)
qb_5 = QuickBaker(Geometry=pt_5, Bake=values_39.Values, referenceAll=1)

crv = Curve([_2d_surface_analysis_2.lines, _2d_surface_analysis.lines])
preview_6 = CustomPreview(Geometry=crv, Material=colour_3)
crv_2 = Curve(flatten([_2d_surface_analysis_2.lines, _2d_surface_analysis.lines]))

# ---- group: 555
gate_10 = StreamGate(Stream=_555.cloud, Gate=0)  # -> Target0, Target1
gate_11 = StreamGate(Stream=_555.geo, Gate=0)  # -> Target0, Target1
cluster_2 = Cluster(P=gate_10.Target0, G=gate_11.Target0, M=colour_4)

# ---- group: Display no.of points
label_3 = CreateLabel(LabelText="no.nodes", LabelSize=12, Justification=0)
label_4 = CreateLabel(LabelText="Number of Nodes :", LabelSize=12, Justification=0)
setlabel = SetLabelContents(LabelToModify=label_3, NewLabelContents=_2d_surface_analysis_2.no_of_nodes)
stack_22 = CreateStack(UIElements=[label_4, label_3], Horizontal=True)

# ---- group: Toggle poitns on and off
toggle_8 = CreateToggle(Default=Toggle(False), Label="Activate the nodes")
values_52 = ValueListener(Elements=toggle_8, NameFilterS=toggle_8, SomeProperty=True)  # -> Values, Indices

# ----
qb_6 = QuickBaker(
    Geometry=flatten([_2d_surface_analysis_2.nodes, _2d_surface_analysis.nodes]),
    Layer="nodes",
    Bake=values_52.Values,
    referenceAll=1)

# ---- group: Node Generation
merge_3 = Merge(Data1=stack_12, Data3=label, Data4=slider, Data5=toggle_8, Data6=stack_22)
merge_4 = Merge(Data1=merge_3)

# ---- group: CONNECT
merge_5 = Merge(
    Data1=stack_6,
    Data2=stack_2,
    Data3=stack_5,
    Data4=stack_7,
    Data5=stack_10,
    Data6=stack_9,
    Data7=stack_8,
    Data8=stack,
    Data9=stack_3,
    Data10=stack_4,
    Data11=stack_11)
interconnect = INTERCONNECT(
    underlying_grid=flatten([crv_2, ln_5, ln_3, ln_4, ln]),
    ap=values_12.Values,
    bp=values_4.Values,
    cp=values_10.Values,
    dp=values_14.Values,
    ep=values_20.Values,
    fp_7=values_18.Values,
    fp_3=values_16.Values,
    fp_5=values_2.Values,
    fp_2=values_6.Values,
    fp_4=values_8.Values,
    fp_6=values_22.Values)  # -> A, B, C, D_9, D_7, D_8, D_3, D_5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

# ----
# UI geneator
number_slider_2 = Slider(500, range=0..1000)
launchwin = LaunchWindow(Show=Toggle(True), Name="Surface prepartion", Width=number_slider_2, Height=400, ChildStatus=1, EnableHorizScroll=False)
split = SplitList(List=merge_5, Index=subtraction)  # -> ListA, ListB
simplegrid = CreateSimpleGrid(UIElements=split.ListA, RowDefinitions="2*", ColumnDefinitions="2*")

# ---- group: Draw Interconnect
label_5 = CreateLabel(LabelText="Circuit Drawing", LabelSize=24, Justification=0)
label_6 = CreateLabel(LabelText="             ", LabelSize=12, Justification=0)
merge_6 = Merge(Data1=label_6, Data2=label_5, Data3=pulldown_2, Data4=simplegrid)

# ----
toggle_9 = CreateToggle(Default=Toggle(False), Label="Export the traces")
values_53 = ValueListener(Elements=toggle_9, SomeProperty=True)  # -> Values, Indices

stack_23 = CreateStack(UIElements=[toggle_9, toggle], Horizontal=Toggle(False))  # -> flatten(Stack)

merge_7 = Merge(
    Data1=merge_4,
    Data2=merge_2,
    Data3=merge_6,
    Data4=stack_15,
    Data5=stack_23,
    Data6=stack_14,
    Data7=slider_6,
    Data8=stack_13,
    Data9=stack_16)
addelems = AddElements(Window=launchwin, Elements=flatten(merge_7), DoVLChecking=True)  # -> AddedElements, ElementNames

# ---- group: Draw Interconnect
crv_3 = Curve(graft([interconnect.A, interconnect.B, interconnect.C, interconnect.D_9, interconnect.D_7, interconnect.D_8, interconnect.D_3, interconnect.D_5, interconnect.D_2, interconnect.D_4, interconnect.D_6, interconnect.D]))
division_2 = Division(A=values_31.Values, B=Slider(2, range=0..10))
neg_2 = Negative(Value=division_2)
dom = ConstructDomain(DomainStart=neg_2, DomainEnd=division_2)
pframe = PerpFrame(Curve=reparameterize(crv_3), Parameter=Slider(0, range=0..100))

# ---- group: EXTRUDE DIRECTION
end = EndPoints(Curve=crv_3)  # -> Start, End
pdecon = Deconstruct(Point=end.Start)  # -> XComponent, YComponent, ZComponent
clean = CleanTree(RemoveNulls=True, RemoveInvalid=True, RemoveEmpty=False, Tree=pdecon.ZComponent)
item_2 = ListItem(List=clean, Index=0, Wrap=True)
number_slider_3 = Slider(1, range=0..1)
smaller = SmallerThan(FirstNumber=item_2, SecondNumber=Slider(0, range=0..100))  # -> SmallerThan, OrEqualTo
num = Number(smaller.SmallerThan)
panel = Panel(num)
replace = ReplaceMembers(Set=num, Find=Slider(0, range=0..100), Replace=Slider(-1, range=-1..1))

# ----
multiplication_2 = Multiplication(A=values_32.Values, B=replace)

# ---- group: Draw Interconnect (continued)
rectangle = Rectangle(Plane=pframe, XSize=multiplication_2, YSize=dom, Radius=0)  # -> Rectangle, Length
swp1 = Sweep1(Rail=crv_3, Sections=rectangle.Rectangle, Miter=1)
cap_2 = CapHoles(Brep=swp1)

# ----
sdiff = SolidDifference(BrepsA=cap_2, BrepsB=cyl)
null = NullItem(Item=sdiff)  # -> NullFlags, InvalidFlags, Description

# ---- group: Draw Interconnect
colour_8 = ColourPicker(PickedColour=RGB(255, 148, 77))

# ---- group: Boolean Difference FInal Shape
brep_3 = Brep(brep)
colour_9 = ColourPicker(PickedColour=RGBA(217, 217, 217, 145))

# ----
sdiff_2 = SolidDifference(BrepsA=graft(brep_3), BrepsB=flatten(cap_2))
null_2 = NullItem(Item=sdiff_2)  # -> NullFlags, InvalidFlags, Description

item_3 = ListItem(List=flatten(item_2), Index=0, Wrap=True)  # -> flatten(Item)
abs = Absolute(Value=item_3)
multiplication_3 = Multiplication(A=abs, B=Slider(2, range=0..10))
neg_3 = Negative(Value=multiplication_3)
Z = UnitZ(Factor=neg_3)
number_slider_4 = Slider(-1, range=-1..1)
extr = Extrude(Base=item, Direction=Z)
cap_3 = CapHoles(Brep=extr)
offset = OffsetSurface(Surface=extr, Distance=number_slider_4, Retrim=Toggle(False))
cap_4 = CapHoles(Brep=offset)
sdiff_3 = SolidDifference(BrepsA=cap_4, BrepsB=cap_3)

filter = StreamFilter(Gate=null.NullFlags, Stream0=[sdiff, sdiff_3], Stream1=cap_2)

qb_7 = QuickBaker(Geometry=[sdiff, sdiff_3, cap], Bake=values_53.Values, referenceAll=1)

# ---- group: Draw Interconnect (continued)
preview_7 = CustomPreview(Geometry=[filter, sdiff_3, cap], Material=colour_8)

# ----
abs_2 = Absolute(Value=number_slider_4)
addition = Addition(A=values_36.PitchDimension, B=abs_2)
cir = Circle(Plane=pl, Radius=addition)

cyl_3 = Cylinder(Base=pl, Radius=addition, Length=neg)

sdiff_4 = SolidDifference(BrepsA=sdiff_2, BrepsB=cyl_3)
null_3 = NullItem(Item=sdiff_4)  # -> NullFlags, InvalidFlags, Description
filter_2 = StreamFilter(Gate=null_2.NullFlags, Stream0=sdiff_4, Stream1=brep_3)
filter_3 = StreamFilter(Gate=null_3.NullFlags, Stream0=sdiff_4, Stream1=sdiff_2)
qb_8 = QuickBaker(Geometry=sdiff_4, Bake=values_35.Values, referenceAll=1)

# ---- group: Boolean Difference FInal Shape (continued)
preview_8 = CustomPreview(Geometry=[filter_2, filter_3], Material=colour_9)

# ----
multiplication_4 = Multiplication(A=abs_2, B=Slider(2, range=0..10))
addition_2 = Addition(A=multiplication, B=multiplication_4)
division_3 = Division(A=addition_2, B=Slider(2, range=0..10))

# ==== cluster _2DSurfaceAnalysis
pitch_dimension = ClusterInput()
S = ClusterInput()
dim = Dimensions(Surface=S)  # -> UDimension, VDimension
division = Division(A=dim.UDimension, B=pitch_dimension)
division_2 = Division(A=dim.VDimension, B=pitch_dimension)
sdivide = DivideSurface(Surface=S, UCount=division, VCount=division_2)  # -> simplify(flatten(Points)), Normals, Parameters
clean = CleanTree(RemoveNulls=True, RemoveInvalid=True, RemoveEmpty=False, Tree=sdivide.Points)
pt = Point(simplify(flatten(clean)))
pt_2 = Point(simplify(graft(clean)))
cps = ClosestPoints(Point=pt_2, Cloud=pt, Count=Slider(9, range=0..10))  # -> ClosestPoint, CPIndex, Distance
lng = ListLength(List=pt)
ln = Line(StartPoint=pt_2, EndPoint=cps.ClosestPoint)
no_of_nodes = ClusterOutput(lng)
lines = ClusterOutput(ln)
nodes = ClusterOutput(pt)

# ==== cluster _555
brep = Brep([<brep referenced from the Rhino model> x9])
pt = Point([<point referenced from the Rhino model> x8])
rotation = ClusterInput()
location = ClusterInput()
pt_2 = Point(location)
pt_3 = Point(pt_2)

# ---- group: Centre of Pins
shift = ShiftList(List=pt, Shift=1, Wrap=True)
ln = Line(StartPoint=pt, EndPoint=shift)
join = JoinCurves(Curves=ln, Preserve=False)
pcen = PolygonCenter(Polyline=join)  # -> CenterV, CenterE, CenterA

# ----
number_slider = Slider(90, range=0..1000)

# ---- group: EXTRUDE DIRECTION
pdecon = Deconstruct(Point=pt_3)  # -> XComponent, YComponent, ZComponent
clean = CleanTree(RemoveNulls=True, RemoveInvalid=True, RemoveEmpty=False, Tree=pdecon.ZComponent)
item = ListItem(List=clean, Index=0, Wrap=True)
larger = LargerThan(FirstNumber=item, SecondNumber=Slider(0, range=0..100))  # -> LargerThan, OrEqualTo
filter = StreamFilter(Gate=larger.LargerThan, Stream0=Slider(-1, range=-1..1), Stream1=Slider(1, range=0..1))

# ----
rad = Radians(Degrees=rotation)
Z = UnitZ(Factor=filter)
pl = PlaneNormal(Origin=pt_2, ZAxis=Z)
rotate = Rotate(Geometry=pl, Angle=rad, Plane=pl)  # -> Geometry, Transform
orient = Orient(Geometry=pt, Source=pcen.CenterV, Target=rotate.Geometry)  # -> Geometry, Transform
orient_2 = Orient(Geometry=brep, Source=pcen.CenterV, Target=rotate.Geometry)  # -> Geometry, Transform
colour = ColourPicker(PickedColour=RGBA(78, 92, 120, 120))
sph = Sphere(Base=orient.Geometry, Radius=Slider(0.1, range=0..1))
preview = CustomPreview(Geometry=orient_2.Geometry, Material=colour)
colour_2 = ColourPicker(PickedColour=RGBA(255, 66, 66, 213))
preview_2 = CustomPreview(Geometry=sph, Material=colour_2)
item_2 = ListItem(List=orient.Geometry, Index="0", Wrap=True)
item_3 = ListItem(List=orient.Geometry, Index="1", Wrap=True)
item_4 = ListItem(List=orient.Geometry, Index="2", Wrap=True)
item_5 = ListItem(List=orient.Geometry, Index="3", Wrap=True)
item_6 = ListItem(List=orient.Geometry, Index="4", Wrap=True)
item_7 = ListItem(List=orient.Geometry, Index="5", Wrap=True)
item_8 = ListItem(List=orient.Geometry, Index="6", Wrap=True)
item_9 = ListItem(List=orient.Geometry, Index="7", Wrap=True)
geo = ClusterOutput(orient_2.Geometry)
_1 = ClusterOutput(item_2)
_2 = ClusterOutput(item_3)
_3 = ClusterOutput(item_4)
_4 = ClusterOutput(item_5)
_8 = ClusterOutput(item_9)
_5 = ClusterOutput(item_6)
_6 = ClusterOutput(item_7)
_7 = ClusterOutput(item_8)
cloud = ClusterOutput(orient.Geometry)

# ==== cluster LED
number_slider = Slider(0.5, range=0..10)
neg = Negative(Value=number_slider)
location = ClusterInput()
rotation = ClusterInput()
brep = Brep([<brep referenced from the Rhino model> x3])
pt = Point([<point referenced from the Rhino model> x2])
Y = UnitY(Factor=[neg, number_slider])
pt_2 = Point(location)
pt_3 = Point(pt_2)
move = Move(Geometry=pt, Motion=Y)  # -> Geometry, Transform
panel = Panel(move.Geometry)
number_slider_2 = Slider(90, range=0..1000)

# ---- group: EXTRUDE DIRECTION
pdecon = Deconstruct(Point=pt_3)  # -> XComponent, YComponent, ZComponent
clean = CleanTree(RemoveNulls=True, RemoveInvalid=True, RemoveEmpty=False, Tree=pdecon.ZComponent)
item = ListItem(List=clean, Index=0, Wrap=True)
larger = LargerThan(FirstNumber=item, SecondNumber=Slider(0, range=0..100))  # -> LargerThan, OrEqualTo
filter = StreamFilter(Gate=larger.LargerThan, Stream0=Slider(-1, range=-1..1), Stream1=Slider(1, range=0..1))

# ----
rad = Radians(Degrees=rotation)
Z = UnitZ(Factor=filter)
pl = PlaneNormal(Origin=pt_2, ZAxis=Z)
rotate = Rotate(Geometry=pl, Angle=rad, Plane=pl)  # -> Geometry, Transform
amp = Amplitude(Vector=Z, Amplitude=Slider(2, range=0..10))
colour = ColourPicker(PickedColour=RGBA(255, 66, 66, 213))

# ---- group: Centre of Pins
shift = ShiftList(List=move.Geometry, Shift=1, Wrap=True)
ln = Line(StartPoint=move.Geometry, EndPoint=shift)

# ----
item_2 = ListItem(List=ln, Index=0, Wrap=True)
panel_2 = Panel(item_2)

# ---- group: Centre of Pins (continued)
pcen = PolygonCenter(Polyline=item_2)  # -> CenterV, CenterE, CenterA

# ----
orient = Orient(Geometry=move.Geometry, Source=pcen.CenterV, Target=rotate.Geometry)  # -> Geometry, Transform
orient_2 = Orient(Geometry=brep, Source=pcen.CenterV, Target=rotate.Geometry)  # -> Geometry, Transform
move_2 = Move(Geometry=orient.Geometry, Motion=amp)  # -> Geometry, Transform
preview = CustomPreview(
    Geometry=orient_2.Geometry,
    Material={diffuse=RGB(221, 160, 221), emission=RGB(66, 48, 66), shine=0.5, specular=RGB(255, 255, 255), transparency=0})
item_3 = ListItem(List=orient.Geometry, Index="0", Wrap=True)
item_4 = ListItem(List=move_2.Geometry, Index="1", Wrap=True)
item_5 = ListItem(List=move_2.Geometry, Index=0, Wrap=True)
item_6 = ListItem(List=orient.Geometry, Index="1", Wrap=True)
preview_2 = ClusterOutput(item_5)
geo = ClusterOutput(orient_2.Geometry)
preview_3 = ClusterOutput(item_4)
x = ClusterOutput(item_3)
x_2 = ClusterOutput(item_6)
cloud = ClusterOutput(orient.Geometry)
sph = Sphere(Base=orient.Geometry, Radius=Slider(0.1, range=0..1))
preview_4 = CustomPreview(Geometry=sph, Material=colour)

# ==== cluster INTERCONNECT
underlying_grid = ClusterInput()
ap = ClusterInput()
fp = ClusterInput()
bp = ClusterInput()
fp_2 = ClusterInput()
fp_3 = ClusterInput()
fp_4 = ClusterInput()
fp_5 = ClusterInput()
fp_6 = ClusterInput()
cp = ClusterInput()
ep = ClusterInput()
fp_7 = ClusterInput()
dp = ClusterInput()
path_planning = PathPlanning(V=bp)
path_planning_2 = PathPlanning(V=ap)
path_planning_3 = PathPlanning_2(V=fp)
path_planning_4 = PathPlanning_2(V=fp_2)
path_planning_5 = PathPlanning_2(V=fp_3)
path_planning_6 = PathPlanning_2(V=fp_4)
path_planning_7 = PathPlanning_2(V=fp_5)
path_planning_8 = PathPlanning_2(V=fp_6)
path_planning_9 = PathPlanning(V=cp)
path_planning_10 = PathPlanning_2(V=ep)
path_planning_11 = PathPlanning_2(V=fp_7)
path_planning_12 = PathPlanning(V=dp)
shortwalk = ShortestWalk(Curves=underlying_grid, WantedPath=path_planning_3)  # -> ShortestWalk, Succession, Direction, Length
shortwalk_2 = ShortestWalk(Curves=underlying_grid, WantedPath=path_planning_4)  # -> ShortestWalk, Succession, Direction, Length
shortwalk_3 = ShortestWalk(Curves=underlying_grid, WantedPath=path_planning_5)  # -> ShortestWalk, Succession, Direction, Length
shortwalk_4 = ShortestWalk(Curves=underlying_grid, WantedPath=path_planning_6)  # -> ShortestWalk, Succession, Direction, Length
shortwalk_5 = ShortestWalk(Curves=underlying_grid, WantedPath=path_planning_7)  # -> ShortestWalk, Succession, Direction, Length
shortwalk_6 = ShortestWalk(Curves=underlying_grid, WantedPath=path_planning_8)  # -> ShortestWalk, Succession, Direction, Length
shortwalk_7 = ShortestWalk(Curves=underlying_grid, WantedPath=path_planning)  # -> ShortestWalk, Succession, Direction, Length
shortwalk_8 = ShortestWalk(Curves=underlying_grid, WantedPath=path_planning_11)  # -> ShortestWalk, Succession, Direction, Length
shortwalk_9 = ShortestWalk(Curves=underlying_grid, WantedPath=path_planning_9)  # -> ShortestWalk, Succession, Direction, Length
shortwalk_10 = ShortestWalk(Curves=underlying_grid, WantedPath=path_planning_2)  # -> ShortestWalk, Succession, Direction, Length
shortwalk_11 = ShortestWalk(Curves=underlying_grid, WantedPath=path_planning_10)  # -> ShortestWalk, Succession, Direction, Length
shortwalk_12 = ShortestWalk(Curves=underlying_grid, WantedPath=path_planning_12)  # -> ShortestWalk, Succession, Direction, Length
join = JoinCurves(Curves=shortwalk_7.ShortestWalk, Preserve=False)
join_2 = JoinCurves(Curves=shortwalk_9.ShortestWalk, Preserve=False)
join_3 = JoinCurves(Curves=shortwalk_10.ShortestWalk, Preserve=False)
join_4 = JoinCurves(Curves=shortwalk_11.ShortestWalk, Preserve=False)
join_5 = JoinCurves(Curves=shortwalk.ShortestWalk, Preserve=False)
join_6 = JoinCurves(Curves=shortwalk_2.ShortestWalk, Preserve=False)
join_7 = JoinCurves(Curves=shortwalk_3.ShortestWalk, Preserve=False)
join_8 = JoinCurves(Curves=shortwalk_4.ShortestWalk, Preserve=False)
join_9 = JoinCurves(Curves=shortwalk_5.ShortestWalk, Preserve=False)
join_10 = JoinCurves(Curves=shortwalk_6.ShortestWalk, Preserve=False)
join_11 = JoinCurves(Curves=shortwalk_8.ShortestWalk, Preserve=False)
join_12 = JoinCurves(Curves=shortwalk_12.ShortestWalk, Preserve=False)
pline = PolyLine(Closed=False)
pline_2 = PolyLine(Closed=False)
pull = PullCurve()
pull_2 = PullCurve(Curve=pline)
pull_3 = PullCurve()
pull_4 = PullCurve(Curve=pline_2)
midpt = CurveMiddle()
midpt_2 = CurveMiddle()
midpt_3 = CurveMiddle()
midpt_4 = CurveMiddle()
midpt_5 = CurveMiddle()
midpt_6 = CurveMiddle()
c_script = CSharpScript(T="5", P=midpt)  # -> out, A; inputs T: String, P: Point3d
# ---------- c_script: C# usings ----------
using System.IO;
using System.Linq;
using System.Data;
using System.Drawing;
using System.Reflection;
using System.Windows.Forms;
using System.Xml;
using System.Xml.Linq;
using System.Runtime.InteropServices;

using Rhino.DocObjects;
using Rhino.Collections;
using GH_IO;
using GH_IO.Serialization;
# ---------- c_script: C# ----------
    _text.Add(T);
    _points.Add(P);
# ---------- c_script: C# additional code ----------
  private readonly List<string> _text = new List<string>();
  private readonly List<Point3d> _points = new List<Point3d>();

  /// <summary>
  /// This method will be called once every solution, before any calls to RunScript.
  /// </summary>
  public override void BeforeRunScript()
  {
    _text.Clear();
    _points.Clear();
  }

  //Draw all meshes in this method.
  public override void DrawViewportMeshes(IGH_PreviewArgs args)
  {
    for (int i = 0; i < _text.Count; i++)
    {
      Plane plane ;
      args.Viewport.GetCameraFrame(out plane);
      plane.Origin = _points[i];

      args.Display.Draw3dText(_text[i], Color.Black, plane, 1.5, "Lucida Console");
    }
  }
# ---------- end c_script ----------
c_script_2 = CSharpScript(T="6", P=midpt_2)  # -> out, A; inputs T: String, P: Point3d; same code as c_script
c_script_3 = CSharpScript(T="4", P=midpt_4)  # -> out, A; inputs T: String, P: Point3d; same code as c_script
c_script_4 = CSharpScript(T="1", P=midpt_6)  # -> out, A; inputs T: String, P: Point3d
# ---------- c_script_4: C# ----------
    _text.Add(T);
    _points.Add(P);
# ---------- c_script_4: C# additional code ----------
  private readonly List<string> _text = new List<string>();
  private readonly List<Point3d> _points = new List<Point3d>();

  /// <summary>
  /// This method will be called once every solution, before any calls to RunScript.
  /// </summary>
  public override void BeforeRunScript()
  {
    _text.Clear();
    _points.Clear();
  }

  //Draw all meshes in this method.
  public override void DrawViewportMeshes(IGH_PreviewArgs args)
  {
    for (int i = 0; i < _text.Count; i++)
    {
      Plane plane ;
      args.Viewport.GetCameraFrame(out plane);
       plane.Origin = _points[i];

      args.Display.Draw3dText(_text[i], Color.Black, plane, 1.5, "Lucida Console");
    }
  }
# ---------- end c_script_4 ----------
c_script_5 = CSharpScript(T="3", P=midpt_5)  # -> out, A; inputs T: String, P: Point3d; same code as c_script
c_script_6 = CSharpScript(T="2", P=midpt_3)  # -> out, A; inputs T: String, P: Point3d
# ---------- c_script_6: C# ----------
    _text.Add(T);
    _points.Add(P);
# ---------- c_script_6: C# additional code ----------
  private readonly List<string> _text = new List<string>();
  private readonly List<Point3d> _points = new List<Point3d>();

  /// <summary>
  /// This method will be called once every solution, before any calls to RunScript.
  /// </summary>
  public override void BeforeRunScript()
  {
    _text.Clear();
    _points.Clear();
  }

  //Draw all meshes in this method.
  public override void DrawViewportMeshes(IGH_PreviewArgs args)
  {
    for (int i = 0; i < _text.Count; i++)
    {
      Plane plane ;
      args.Viewport.GetCameraFrame(out plane);
         plane.Origin = _points[i];

      args.Display.Draw3dText(_text[i], Color.Black, plane, 1.5, "Lucida Console");
    }
  }
# ---------- end c_script_6 ----------
D = ClusterOutput(join_5)
D_2 = ClusterOutput(join_6)
D_3 = ClusterOutput(join_7)
D_4 = ClusterOutput(join_8)
D_5 = ClusterOutput(join_9)
D_6 = ClusterOutput(join_10)
D_7 = ClusterOutput(join_4)
D_8 = ClusterOutput(join_11)
B = ClusterOutput(join)
C = ClusterOutput(join_2)
A = ClusterOutput(join_3)  # A
D_9 = ClusterOutput(join_12)

# ==== cluster Cluster
P = ClusterInput()
G = ClusterInput()
M = ClusterInput()
points = PointList(Points=P, Size=Slider(1.5, range=0..10))
preview = CustomPreview(Geometry=G, Material=M)

# ==== cluster JST
rotation = ClusterInput()
location = ClusterInput()
brep = Brep([<brep referenced from the Rhino model> x3])
pt = Point([<point referenced from the Rhino model> x2])
pt_2 = Point([<point referenced from the Rhino model> x2])

# ---- group: Centre of Pins
shift = ShiftList(List=pt, Shift=1, Wrap=True)
ln = Line(StartPoint=pt, EndPoint=shift)
join = JoinCurves(Curves=ln, Preserve=False)
pcen = PolygonCenter(Polyline=join)  # -> CenterV, CenterE, CenterA

# ----
pt_3 = Point(location)
pt_4 = Point(pt_3)

# ---- group: EXTRUDE DIRECTION
pdecon = Deconstruct(Point=pt_4)  # -> XComponent, YComponent, ZComponent
clean = CleanTree(RemoveNulls=True, RemoveInvalid=True, RemoveEmpty=False, Tree=pdecon.ZComponent)
item = ListItem(List=clean, Index=0, Wrap=True)
larger = LargerThan(FirstNumber=item, SecondNumber=Slider(0, range=0..100))  # -> LargerThan, OrEqualTo
filter = StreamFilter(Gate=larger.LargerThan, Stream0=Slider(-1, range=-1..1), Stream1=Slider(1, range=0..1))

# ----
number_slider = Slider(90, range=0..1000)
rad = Radians(Degrees=rotation)
Z = UnitZ(Factor=filter)
pl = PlaneNormal(Origin=pt_3, ZAxis=Z)
rotate = Rotate(Geometry=pl, Angle=rad, Plane=pl)  # -> Geometry, Transform
orient = Orient(Geometry=pt_2, Source=pcen.CenterV, Target=rotate.Geometry)  # -> Geometry, Transform
orient_2 = Orient(Geometry=brep, Source=pcen.CenterV, Target=rotate.Geometry)  # -> Geometry, Transform
item_2 = ListItem(List=orient.Geometry, Index="0", Wrap=True)
item_3 = ListItem(List=orient.Geometry, Index="1", Wrap=True)
c_script = CSharpScript(T="+", P=item_2)  # -> out, A; inputs T: String, P: Point3d; same code as c_script
c_script_2 = CSharpScript(T="-", P=item_3)  # -> out, A; inputs T: String, P: Point3d; same code as c_script
geo = ClusterOutput(orient_2.Geometry)
x = ClusterOutput(item_2)
x_2 = ClusterOutput(item_3)
cloud = ClusterOutput(orient.Geometry)

# ==== cluster Cluster_2
B = ClusterInput()
debrep = DeconstructBrep(Brep=B)  # -> Faces, Edges, Vertices
area = Area(Geometry=debrep.Faces)  # -> Area, Centroid
pdecon = Deconstruct(Point=area.Centroid)  # -> XComponent, YComponent, ZComponent
sort = SortList(Keys=pdecon.ZComponent, ValuesA=debrep.Faces)  # -> Keys, ValuesA
lng = ListLength(List=sort.ValuesA)
subtraction = Subtraction(A=lng, B=Slider(1, range=0..1))
item = ListItem(List=sort.ValuesA, Index=subtraction, Wrap=True)
item_2 = ListItem(List=sort.ValuesA, Index=Slider(0, range=0..10), Wrap=True)
bottom_surface = ClusterOutput(item_2)
top_surface = ClusterOutput(item)

# ==== cluster PathPlanning
V = ClusterInput()
pt1 = ClusterInput()
pt2 = ClusterInput()
pt = Point(flatten(pt2))
pt_2 = Point(flatten(pt1))

pline = PolyLine(Vertices=V, Closed=False)
end = EndPoints(Curve=pline)  # -> Start, End
ln = Line(StartPoint=pt_2, EndPoint=end.Start)
ln_2 = Line(StartPoint=end.End, EndPoint=pt)
ln_3 = Line(StartPoint=pt_2, EndPoint=pt)
explode = Explode(Curve=[ln_2, ln, pline], Recursive=True)  # -> simplify(flatten(Segments)), Vertices
lng = ListLength(List=flatten(explode.Segments))  # -> flatten(Length)
null = NullItem(Item=lng)  # -> NullFlags, InvalidFlags, Description
bool = Boolean(invert(null.NullFlags))

panel = Panel(pt_2)
panel_2 = Panel(pt)
filter = StreamFilter(Gate=bool, Stream0=ln_3, Stream1=explode.Segments)
item = ListItem(List=filter, Index=Slider(1, range=0..1), Wrap=True)
panel_3 = Panel(filter)
s_1 = ClusterOutput(filter)

# ==== cluster PathPlanning_2
V = ClusterInput()
pt1 = ClusterInput()
pt2 = ClusterInput()
pt = Point(flatten(pt2))
pt_2 = Point(flatten(pt1))

pline = PolyLine(Vertices=V, Closed=False)
end = EndPoints(Curve=pline)  # -> Start, End
ln = Line(StartPoint=pt_2, EndPoint=end.Start)
ln_2 = Line(StartPoint=end.End, EndPoint=pt)
ln_3 = Line(StartPoint=pt_2, EndPoint=pt)
explode = Explode(Curve=[ln_2, ln, pline], Recursive=True)  # -> simplify(flatten(Segments)), Vertices
lng = ListLength(List=flatten(explode.Segments))  # -> flatten(Length)
null = NullItem(Item=lng)  # -> NullFlags, InvalidFlags, Description
bool = Boolean(invert(null.NullFlags))

panel = Panel(pt_2)
panel_2 = Panel(pt)
filter = StreamFilter(Gate=bool, Stream0=ln_3, Stream1=explode.Segments)
item = ListItem(List=filter, Index=Slider(1, range=0..1), Wrap=True)
panel_3 = Panel(filter)
s_0 = ClusterOutput(filter)
